# Grasshopper definition ex1_design_tool_orthogonal.ghx (Grasshopper 1.0.7)

panel = Panel("Unload libraries")
bang = Button()
unload = PythonScript(bang=bang)
# ---------- unload: Python ----------
from compas_rhino.utilities.misc import get_tolerance
from compas_rhino.utilities.misc import unload_modules

unload_modules("robot_see_robot_do")
# ---------- end unload ----------

import = Button(ExpressionNormal="True", ExpressionPressed="False")
py = PythonScript(import_from_json=import)  # -> HERE, DATA, import_from_json
# ---------- py: Python ----------
import os
from scriptcontext import sticky as st

HERE = os.path.dirname(ghdoc.Path)
DATA = os.path.abspath(os.path.join(HERE, "..", "data"))
print(HERE)
print(DATA)

st.clear()
st['DATA_PATH'] = DATA
# ---------- end py ----------
initial_assembly = GhPythonScript(DATA=py.DATA, import_from_json=py.import_from_json)  # -> out, assembly; inputs import_from_json: Boolean
# ---------- initial_assembly: Python ----------
import os
import json
from scriptcontext import sticky

from robot_see_robot_do.assembly_orthogonal import Assembly

if import_from_json:
    filename = "rsrd_assembly_2_rods.json"
    PATH = os.path.join(DATA, filename)
    assembly = Assembly.from_json(PATH)


#assembly.network.delete_node(6)

if assembly:
    counter = 1
    for key, elem, data in assembly.elements(data=True):
        data['frame_id'] = counter
        counter +=1
    
    sticky['assembly'] = assembly
# ---------- end initial_assembly ----------

# ----
# Load assembly
panel_2 = Panel("Import assembly")

y_axis = Curve(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)
x_axis = Curve(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)
plane = PythonScript(plane_axes=[x_axis, y_axis])  # -> plane; inputs plane_axes: list of Curve
# ---------- plane: Python ----------
import Rhino.Geometry as rg

x_axis, y_axis = plane_axes

x_axis = rg.Line(x_axis.PointAtStart, x_axis.PointAtEnd)
y_axis = rg.Line(y_axis.PointAtStart, y_axis.PointAtEnd)

if x_axis.From.DistanceTo(y_axis.From) < 0.01:
    origin = x_axis.From
    xvec = x_axis.Direction
    yvec = y_axis.Direction
elif x_axis.To.DistanceTo(y_axis.To) < 0.01:
    origin = x_axis.To
    xvec = -x_axis.Direction
    yvec = -y_axis.Direction
elif x_axis.From.DistanceTo(y_axis.To) < 0.01:
    origin = x_axis.From
    xvec = x_axis.Direction
    yvec = -y_axis.Direction
elif x_axis.To.DistanceTo(y_axis.From) < 0.01:
    origin = x_axis.To
    xvec = -x_axis.Direction
    yvec = y_axis.Direction

plane = rg.Plane(origin, xvec, yvec)
# ---------- end plane ----------

# ----
# Controls
reset = Button()
shift = Slider(-0.2, range=-0.2..0.2)
t = Slider(85, range=0..180)
aggregate = Button()
element = Button()
element_2 = Button()
human = Button()
robot = Button()
add = Button()
list = ValueList({"AA": "BA", "AB": "BB", "BA": "AA", "BB": "AB"}, selected="BB")
target_points = Point([Point(3.668891747, 0.7107020001, 1.820186629), Point(2.035451837, 1.811883324, 0.1857535972)])

sph = Sphere(Base=target_points, Radius=0.05)  # disabled
preview = CustomPreview(Geometry=sph, Material=ColourSwatch(SwatchColor=RGB(255, 92, 92)))  # disabled

# ----
# Assembly Definition
# Create an Element object.
show = BooleanToggle(False)
globals = GhPythonScript()  # -> assembly
# ---------- globals: Python ----------
from robot_see_robot_do.assembly_orthogonal import Assembly

# create assembly
assembly = Assembly()

# create a dictionary to store global value in 
assembly.globals = {}

# define global values
assembly.globals['radius'] = 0.01
assembly.globals['height'] = 1.0
assembly.globals['shift_value'] = 0.25
# ---------- end globals ----------
elem_def = GhPythonScript(assembly=globals)  # -> out, assembly, elem
# ---------- elem_def: Python ----------
import os
import sys
import json
import math

from compas.geometry import Frame, Plane, Rotation, Vector, Point
from compas.geometry import Box, Circle, Cylinder, Translation
from compas.datastructures import Mesh

from robot_see_robot_do.assembly_orthogonal import Element

from compas.artists import Artist

radius = assembly.globals['radius']
height = assembly.globals['height']
shift_value = assembly.globals['shift_value']


cross_section_plane = Plane.from_frame(Frame.worldYZ())
cross_section = Circle(cross_section_plane, radius)
elem_geo = Cylinder(cross_section, height)

T_conn_1 = Translation.from_vector([-shift_value,0,0])
T_conn_2 = Translation.from_vector([shift_value,0,0])

R = Rotation.from_axis_and_angle(Vector.Zaxis(), math.radians(0), [0,0,0])

elem_conn_frame_1 = Frame.worldXY().transformed(T_conn_1*R)
elem_conn_frame_2 = Frame.worldXY().transformed(T_conn_2*R)

elem = Element.from_shape(elem_geo, Frame.worldXY())

elem.connector_frame_1 = elem_conn_frame_1
elem.connector_frame_2 = elem_conn_frame_2
# ---------- end elem_def ----------
draw = PythonScript(elements=elem_def.elem, show=show)  # -> M, F, C; inputs elements: list
# ---------- draw: Python ----------
from compas.artists import Artist

M = []
C = []
F = []
T = []
connectors = []

if show:
    for elem in elements:
        connectors.append(elem.connector_frame_1)
        connectors.append(elem.connector_frame_2)
        M += [Artist(elem._mesh).draw([0,0,1,1])]
        C += [Artist(frame).draw() for frame in connectors]
        F += [Artist(elem.frame).draw()]
        T += [Artist(elem.tool_frame).draw()]
# ---------- end draw ----------
pln = Plane(draw.F)
pln_2 = Plane(draw.C)

mesh = Mesh(draw.M)

custom_preview = CustomPreview(Geometry=mesh, Material=ColourSwatch(SwatchColor=RGB(221, 0, 0)))

# ----
# Design Generation
initial_configuration = GhPythonScript(assembly=elem_def.assembly, elem=elem_def.elem)  # -> out, assembly, connector_planes
# ---------- initial_configuration: Python ----------
import Rhino.Geometry as rg
import math

from compas.geometry import Translation, Rotation, Vector
from compas.artists import Artist


connector_planes = []

# globals
radius = assembly.globals['radius']
height = assembly.globals['height']
shift_value = assembly.globals['shift_value']

R1 = Rotation.from_axis_and_angle(elem.frame.zaxis, math.radians(90), [0,0,0])
R2 = Rotation.from_axis_and_angle(Vector.Yaxis(), math.radians(-90), [0,0,0])

T1 = Translation.from_vector([height*shift_value, 0, 0])
T2 = Translation.from_vector([0, height*shift_value, radius*2])
T3 = Translation.from_vector([radius*2., radius*2., height*shift_value])

# create a transformed copy of the defined element 
elem_1 = elem.transformed(T1)
elem_2 = elem.transformed(T2*R1)
elem_3 = elem.transformed(T3*R2)

# set connector states
elem_1.connector_1_state = False
elem_2.connector_1_state = False
elem_3.connector_1_state = False

# add element to the assembly
assembly.add_element(elem_1, placed_by = 'initial', frame_id=None)
assembly.add_element(elem_2, placed_by = 'initial', frame_id=None)
assembly.add_element(elem_3, placed_by = 'initial', frame_id=None)

# add edges
assembly.network.add_edge(0, 1, edge_of = 'parent')
assembly.network.add_edge(0, 2, edge_of = 'parent')
assembly.network.add_edge(1, 2, edge_of = 'parent')

# print all open connectors
print assembly.connectors(state='open')

# visualize all open connector frames
for connector in assembly.connectors(state='open'):
    for c in connector:
        connector_planes.append(Artist(c).draw())
# ---------- end initial_configuration ----------
pln_3 = Plane(initial_configuration.connector_planes)

# ----
# Transform Assembly
x_axis_2 = Curve(<curve referenced from the Rhino model>)
y_axis_2 = Curve(<curve referenced from the Rhino model>)
plane_2 = PythonScript(plane_axes=[x_axis_2, y_axis_2])  # -> plane; inputs plane_axes: list of Curve; same code as plane
transform = GhPythonScript(assembly=initial_configuration.assembly, transform=Toggle(False), trnsf_plane=plane_2)  # -> out, assembly
# ---------- transform: Python ----------
from compas.geometry import Frame
from compas.geometry import Transformation

if transform:
    T = Transformation.from_frame_to_frame(Frame.worldXY(), Frame(trnsf_plane.Origin, trnsf_plane.XAxis, trnsf_plane.YAxis))
    assembly.transform(T)
    assembly.network.transform(T)
# ---------- end transform ----------

generate_assembly = GhPythonScript(
    assembly=transform.assembly,
    robot_base_plane=plane,
    angle_threshold=t,
    targets=target_points,
    element_up=element,
    element_down=element_2,
    reset=reset,
    flip=list,
    shift_value=shift,
    add_two=add,
    robot_adds=robot,
    human_adds=human,
    aggregate=aggregate)  # -> out, assembly, current_key, coll_mesh, tool_planes; inputs robot_base_plane: Plane, targets: list of Point3d
# ---------- generate_assembly: Python ----------
import Rhino.Geometry as rg
import rhinoscriptsyntax as rs
import math
import random
from scriptcontext import sticky as st
import sys

import ghpythonlib.components as ghcomp

from compas.geometry import Frame, Box, Point
from compas.geometry import Vector, Translation, angle_vectors
from compas.datastructures import mesh_offset
from compas.artists import Artist


from compas.rpc import Proxy

tool_planes = []                     # Tool planes
base_planes = [] 
filtered_keys = []
options = []

#bp = robot_base_plane
#robot_base_frame = Frame(bp.Origin, bp.XAxis, bp.YAxis)

L = list(assembly.elements())

def range_filter(options, robot_base_plane):
    ur_range_max = 1.2
    ur_range_min = 0.75
        
    base_point= Point(robot_base_plane.Origin.X, robot_base_plane.Origin.Y, robot_base_plane.Origin.Z)
    filtered_options = []
    for key, elem_origin, option_vector in options:
        v = Vector.from_start_end(elem_origin, base_point)
        dist = v.length
        if ur_range_min <= dist <= ur_range_max:
            filtered_options.append((key, elem_origin, option_vector))
    return filtered_options

def filter_options(all_options, target_points):
    tps = [Point(p.X, p.Y, p.Z) for p in target_points]
    filtered_options = []
    for tp in tps:
        for key, elem_origin, option_vector in all_options:
            v = Vector.from_start_end(elem_origin, tp)
            angle = angle_vectors(option_vector, v, deg=True)
            if angle < angle_threshold:
                filtered_options.append((key, elem_origin, option_vector))
    return filtered_options

all_options = []

for key, element in assembly.elements():
    for origin, vector in element.options_vectors(0.40):
        all_options.append((key, origin, vector))

assembly.all_options = all_options

filtered_options = filter_options(all_options, targets)
filtered_keys = []
#for option in filtered_options:
#    filtered_keys.append(option[0])
for option in all_options:
    filtered_keys.append(option[0])
    
filtered_keys = list(set(filtered_keys))
print filtered_keys

assembly.current_options = filtered_options


# store data in component
guid = str(ghenv.Component.InstanceGuid)
element_key = "elem_" + guid

if element_key not in st:
    st[element_key] = 0

if reset:
    st[element_key] = 0

if element_up:
    if st[element_key] < len(filtered_keys) - 1:
        st[element_key] += 1

if element_down:
    if st[element_key] <= len(filtered_keys) - 1:
        st[element_key] -= 1

    if st[element_key] < 1:
        st[element_key] = 0


current_key = filtered_keys[st[element_key]]
current_elem = assembly.network.node[current_key]['element']


# Robot adds first element
if robot_adds:
    assembly.add_unit_element(current_key, flip, shift_value, angle=90, placed_by ='robot', on_ground=True, unit_index=0)
    
# Human adds second element element
if human_adds:
    assembly.add_unit_element(current_key, flip, shift_value, angle=90, placed_by ='human', on_ground=True, unit_index=1)

# Add two elements
if add_two:
    assembly.close_unit(current_key, flip, shift_value, angle=90, on_ground = False)
    
if aggregate:
    for i in range (20):
        key_index = assembly.network.key_index()
        keys = [key_index[key] for key in assembly.network.nodes()]
        index = random.randint(0, len(keys)-1)
        random_shift_value = random.uniform(-0.25, 0.25)
        current_key = keys[index]
        current_elem = assembly.network.node[current_key]['element']
        elem_connector = assembly.element(current_key).connectors(state='open')
        if current_elem.connector_1_state or current_elem.connector_2_state:
            flip_index = random.randint(0, 3)
            flip = ['AA', 'AB', 'BA', 'BB'][flip_index]
            #random_angle = random.uniform(0., 360.)
            random_angle = 90
            assembly.close_unit(current_key, flip, random_shift_value, random_angle, on_ground = False)
            #assembly.range_filter(base_frame)
        else:
            print 'No open connectors'

key_index = assembly.network.key_index()
keys = [key_index[key] for key in assembly.network.nodes()]
new_keys = keys[-2:]
print(new_keys)

for key in keys:
    element = assembly.element(key)
    tool_planes.append(Artist(element.tool_frame).draw())
    #print key, ':', assembly.network.node_attribute(key, 'elem_type')

"""

#Collision_check test
T = Translation.from_vector([0.1, -0.024 , 0])
new_elem = elem_x.transformed(T)
coll_mesh = Artist(new_elem.mesh).draw()

c = assembly.collision_check(new_elem, tolerance = -0.001)
#print c



### UNSOLVED: Error loading compas_cgal intersection module's .dll file ###

collision_func = Proxy('assembly_information_model.assembly.collision', python = 'C://Users//lidet//anaconda3//envs//cgal//python.exe')

print collision_func._python

collision_func.stop_server()
collision_func.start_server()

test = collision_func.collision_check_cgal(assembly, new_elem)
print test
"""


print(shift_value)
# ---------- end generate_assembly ----------
current_key = Panel(generate_assembly.current_key)
mesh_2 = Mesh(generate_assembly.coll_mesh)
pln_4 = Plane(generate_assembly.tool_planes)

# ----
# Visualization
# 1. Visualize assembly.
# 2. Visualize selected connector.
# 3. Visuilize all options.
# 4. Visuilize filtered options.
show_2 = BooleanToggle(True)
show_3 = BooleanToggle(True)
show_4 = BooleanToggle(False)
show_5 = BooleanToggle(False)
draw_2 = PythonScript(
    assembly=generate_assembly.assembly,
    show_assembly=show_2,
    show_selected=show_3,
    show_all_options=show_4,
    show_filtered_options=show_5,
    current_key=generate_assembly.current_key,
    flip=list,
    shift_value=shift)  # -> out, G_initial, G_built_by_human, G_built_by_robot, G_option_human, G_option_robot, connector_planes, pr, vr, elem_option_robot; inputs current_key: Int32
# ---------- draw_2: Python ----------
import os
import sys
from scriptcontext import sticky as st
import Rhino.Geometry as rg

from compas.artists import Artist

connector_planes = []
G_initial = []
G_built_by_human = []
G_built_by_robot = []
G_option_robot = []
G_option_human = []
vr = []
pr = []

radius = assembly.globals['radius']

def show(element, output_geo, color):
    mesh = Artist(element.mesh).draw(color)
    output_geo.append(mesh)

def show_multiple(elements, output_geo, color):
    for element in elements:
        mesh = Artist(element.mesh).draw(color)
        output_geo.append(mesh)

current_element = assembly.element(current_key)
elem_options = assembly.element(current_key).options_elements(flip, radius, shift_value, angle=90)

robot_keys = list(assembly.network.nodes_where({'placed_by':'robot'}))
human_keys = list(assembly.network.nodes_where({'placed_by':'human'}))
initial_keys = list(assembly.network.nodes_where({'placed_by':'initial'}))

robot_elements = [assembly.element(key) for key in robot_keys] 
human_elements = [assembly.element(key) for key in human_keys] 
initial_elements = [assembly.element(key) for key in initial_keys] 

# Visualize all open connector frames
connector_planes = [Artist(frame).draw() for elem_connectors in assembly.connectors(state='open') for frame in elem_connectors]

# Visualize assembly
if show_assembly:
    for element in robot_elements:
        mesh = Artist(element.mesh).draw([0.7,0.7,0.75,0.1])
        G_built_by_robot.append(mesh)
    for element in human_elements:
        mesh = Artist(element.mesh).draw([1.,0.7,0.65,0.1])
        G_built_by_human.append(mesh)
    for element in initial_elements:
        mesh = Artist(element.mesh).draw([0.8,0.8,0.8,0.1])
        G_initial.append(mesh)

# Visualise current connector 
if show_selected:
    if elem_options:
        show(elem_options[0], G_option_robot, [0.7,0.9,0.9,0.8])
        show(elem_options[1], G_option_human, [0.8,0.2,0.1,0.1])
    else:
        print('No open connectors')

# Visualize all options
if show_all_options and not show_filtered_options:
    for key, origin, vector in assembly.all_options:
        vr.append(rg.Vector3d(*tuple(vector)))
        pr.append(rg.Point3d(origin.x, origin.y, origin.z))

# Visualize filtered options
if show_filtered_options and not show_all_options:
    for key, o, v in assembly.current_options:
        vr.append(rg.Vector3d(*tuple(v)))
        pr.append(rg.Point3d(o.x, o.y, o.z))

elem_option_robot = elem_options[0] # elem for planning robot routine
# ---------- end draw_2 ----------
mesh_3 = Mesh(draw_2.G_initial)
mesh_4 = Mesh(draw_2.G_built_by_human)
mesh_5 = Mesh(draw_2.G_built_by_robot)
mesh_6 = Mesh(draw_2.G_option_human)
mesh_7 = Mesh(draw_2.G_option_robot)
pln_5 = Plane(draw_2.connector_planes)
pt = Point(draw_2.pr)
vec = Vector(draw_2.vr)
vdis = VectorDisplay(Anchor=pt, Vector=vec)
custom_preview_2 = CustomPreview(Geometry=mesh_3, Material=ColourSwatch(SwatchColor=RGBA(189, 189, 189, 197)))
custom_preview_3 = CustomPreview(Geometry=mesh_4, Material=ColourSwatch(SwatchColor=RGB(255, 196, 196)))
custom_preview_4 = CustomPreview(Geometry=mesh_5, Material=ColourSwatch(SwatchColor=RGBA(154, 196, 212, 164)))
preview_2 = CustomPreview(Geometry=mesh_6, Material=ColourSwatch(SwatchColor=RGB(255, 92, 92)))
custom_preview_5 = CustomPreview(Geometry=mesh_7, Material=ColourSwatch(SwatchColor=RGBA(178, 219, 212, 164)))

# ----
# Network Viz
number_slider = Slider(0, range=0..47)
show_6 = BooleanToggle(True)
network_viz = GhPythonScript(assembly=generate_assembly.assembly, show_network=show_6, key=number_slider)  # -> out, nodes, edges, current_node, current_node_neighbors; inputs key: Int32
# ---------- network_viz: Python ----------
import sys, os
import ghpythonlib.components as ghcomp
import compas
from compas.datastructures import Network
from compas_ghpython.artists import NetworkArtist
from compas_rhino.geometry import RhinoLine

import compas_ghpython
import Rhino.Geometry as rg


data = assembly.network.to_data()
network = Network.from_data(data)

print assembly.network.number_of_nodes()

def draw_network(network):
    """Draw a network in Grasshopper.
    """
    points = []
    for key, attr in network.nodes(True):
        points.append({
            'pos': network.node_coordinates(key),
        })

    lines = []
    for (u, v), attr in network.edges(True):
        lines.append({
            'start': network.node_coordinates(u),
            'end': network.node_coordinates(v),
        })

    points_rg = compas_ghpython.draw_points(points)
    lines_rg = compas_ghpython.draw_lines(lines)

    return points_rg, lines_rg

if show_network:
    nodes, edges = draw_network(network)
    
    current_node = {'pos': network.node_coordinates(key), 'radius': 0.03}
    current_node = compas_ghpython.draw_spheres([current_node])
    
    current_node_neighbors_keys = network.neighbors(key)
    current_node_neighbors = [{'pos': network.node_coordinates(key), 'radius': 0.02} for key in current_node_neighbors_keys]
    current_node_neighbors = compas_ghpython.draw_spheres(current_node_neighbors)
# ---------- end network_viz ----------
pt_2 = Point(network_viz.nodes)
line = Line(network_viz.edges)
brep = Brep(network_viz.current_node)
brep_2 = Brep(network_viz.current_node_neighbors)
preview_3 = CustomPreview(Geometry=brep_2, Material=ColourSwatch(SwatchColor=RGB(255, 207, 207)))
preview_4 = CustomPreview(Geometry=[brep, line], Material=ColourSwatch(SwatchColor=RGB(0, 0, 0)))

# ----
# Export .json
export = Button()
export_2 = Button()
py_2 = PythonScript()  # -> HERE, DATA
# ---------- py_2: Python ----------
import os

HERE = os.path.dirname(ghdoc.Path)
DATA = os.path.abspath(os.path.join(HERE, "..", "data"))
print(HERE)
print(DATA)
# ---------- end py_2 ----------
export_3 = PythonScript(DATA=py_2.DATA, assembly=generate_assembly.assembly, export_to_json=export, export_to_json_unity=export_2)
# ---------- export_3: Python ----------
import os
from compas.datastructures.mesh import mesh_quads_to_triangles
from compas.datastructures.mesh import mesh_unify_cycles

if export_to_json:
    
    filename = "rsrd_assembly.json"
    PATH = os.path.join(DATA, filename)
    
    # the assembly has to be serialized such that it can be called from CPython, True to enable pretty print
    assembly.to_json(PATH, True)
    

if export_to_json_unity:
    
    for key, e in assembly.elements():
    
        #convert to trimesh
        mesh_quads_to_triangles(e._mesh, check_angles=False)
        #mesh_unify_cycles(e._mesh)
        #print e._mesh.faces
        #print e._mesh.face_vertices(list(e._mesh.faces())[0])

    filename = "rsrd_assembly.json"
    PATH = os.path.join(DATA, filename)
    assembly.to_json(PATH)
# ---------- end export_3 ----------
