# Grasshopper definition ex2_design_tool_reciprocal.ghx (Grasshopper 1.0.7)

panel = Panel("Unload libraries")
bang = Button()
unload = PythonScript(bang=bang)
# ---------- unload: Python ----------
from compas_rhino.utilities.misc import get_tolerance
from compas_rhino.utilities.misc import unload_modules

unload_modules("robot_see_robot_do")
# ---------- end unload ----------

pln = Plane(Plane(origin=(-0.002300418726, 0, -0.0370804445), x=(0.8593846672, -0.5, -0.1070420188), y=(-0.4961659689, -0.8660254038, 0.06180073837)))
pln_2 = Plane(Plane(origin=(-0.5976995813, 0.1, -0.0370804445), x=(-0.8593846672, 0.5, -0.1070420188), y=(0.4961659689, 0.8660254038, 0.06180073837)))

# ----
# Assembly Definition
# Create an instance of the HRCElement class by inputing a box geomtry
globals = GhPythonScript()  # -> assembly
# ---------- globals: Python ----------
from robot_see_robot_do.assembly_reciprocal import Assembly

assembly = Assembly()

assembly.globals = {}

assembly.globals['radius'] = 0.01
assembly.globals['height'] = 1.0
assembly.globals['shift_value'] = 0.2
assembly.globals['rf_unit_offset'] = 0.30
assembly.globals['rf_unit_radius'] = 0.1
# ---------- end globals ----------
show = BooleanToggle(False)
elem_def = GhPythonScript(assembly=globals, conn_plane_1=pln, conn_plane_2=pln_2)  # -> out, assembly, elem_x, elem_y, elem_z
# ---------- elem_def: Python ----------
import os
import sys
import json
import math

from compas.geometry import Frame, Plane, Rotation, Translation, Vector
from compas.geometry import Box, Circle, Cylinder
from compas.datastructures import Mesh
from robot_see_robot_do.assembly_reciprocal import Element

rf_unit_offset = assembly.globals['rf_unit_offset']
rf_unit_radius = assembly.globals['rf_unit_radius']
radius = assembly.globals['radius']
height = assembly.globals['height']


def create_rod(frame, ref_name):
    cross_section_plane = Plane.from_frame(Frame(frame.point, frame.yaxis, frame.zaxis))
    cross_section = Circle(cross_section_plane, radius)
    elem_geo = Cylinder(cross_section, height)
    
    T_tool = Translation.from_vector([0,0,radius])
    T_conn_1 = Translation.from_vector(frame.xaxis*(rf_unit_offset+rf_unit_radius)+frame.zaxis*radius)
    T_conn_2 = Translation.from_vector(frame.xaxis*-(rf_unit_offset+rf_unit_radius)+frame.zaxis*-radius)
    #T_conn_1 = Translation.from_vector(frame.xaxis*(rf_unit_offset+rf_unit_radius))
    #T_conn_2 = Translation.from_vector(frame.xaxis*-(rf_unit_offset+rf_unit_radius))
    
    elem_tool_frame = frame.transformed(T_tool)
#    elem_conn_frame_1 = frame.transformed(T_conn_1)
#    elem_conn_frame_2 = frame.transformed(T_conn_2)
#    
#    R_conn_frame_1 = Rotation.from_axis_and_angle(elem_conn_frame_1.zaxis, math.radians(120), elem_conn_frame_1.point)
#    R_conn_frame_2 = Rotation.from_axis_and_angle(elem_conn_frame_2.zaxis, math.radians(240), elem_conn_frame_2.point)
#    
#    elem_conn_frame_1.transform(R_conn_frame_1)
#    elem_conn_frame_2.transform(R_conn_frame_2)
    
    elem_conn_frame_1 = Frame(conn_plane_1.Origin, conn_plane_1.XAxis, conn_plane_1.YAxis)
    elem_conn_frame_2 = Frame(conn_plane_2.Origin, conn_plane_2.XAxis, conn_plane_2.YAxis)


    elem = Element.from_shape(elem_geo, frame)
    
    elem.tool_frame = elem_tool_frame
    elem.connector_frame_1 = elem_conn_frame_1
    elem.connector_frame_2 = elem_conn_frame_2
    elem._type = ref_name
    elem._base_frame = Frame([0, 0, 0], [1, 0, 0], [0, 1, 0])
    
    R = Rotation.from_axis_and_angle(frame.yaxis, math.radians(7.2), frame.point)

    elem.transform(R)
    return elem


R1 = Rotation.from_axis_and_angle(Vector.Zaxis(), math.radians(120), [0,0,0])
R2 = Rotation.from_axis_and_angle(Vector.Zaxis(), math.radians(240), [0,0,0])

f1 = Frame([-rf_unit_offset, rf_unit_radius/2., 0], [1, 0, 0], [0, -1, 0])
f2 = f1.transformed(R1)
f3 = f1.transformed(R2)

elem_x = create_rod(f1, 'X')
elem_y = create_rod(f2, 'Z')
elem_z = create_rod(f3, 'Y')
# ---------- end elem_def ----------
draw = PythonScript(elements=elem_def.elem_x, show=show)  # -> M, F, C; inputs elements: list
# ---------- draw: Python ----------
from compas.artists import Artist

M = []
C = []
F = []
T = []
connectors = []

if show:
    for elem in elements:
        connectors.append(elem.connector_frame_1)
        connectors.append(elem.connector_frame_2)
        M += [Artist(elem._mesh).draw([0,0,1,1])]
        C += [Artist(frame).draw() for frame in connectors]
        F += [Artist(elem.frame).draw()]
        T += [Artist(elem.tool_frame).draw()]
# ---------- end draw ----------
pln_3 = Plane(draw.F)
pln_4 = Plane(draw.C)
mesh = Mesh(draw.M)
custom_preview = CustomPreview(Geometry=mesh, Material=ColourSwatch(SwatchColor=RGB(221, 0, 0)))

x = Curve(<curve referenced from the Rhino model>)

x_axis = Curve(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)
y_axis = Curve(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)
plane = PythonScript(plane_axes=[x_axis, y_axis])  # -> plane; inputs plane_axes: list of Curve
# ---------- plane: Python ----------
import Rhino.Geometry as rg

x_axis, y_axis = plane_axes

x_axis = rg.Line(x_axis.PointAtStart, x_axis.PointAtEnd)
y_axis = rg.Line(y_axis.PointAtStart, y_axis.PointAtEnd)

if x_axis.From.DistanceTo(y_axis.From) < 0.01:
    origin = x_axis.From
    xvec = x_axis.Direction
    yvec = y_axis.Direction
elif x_axis.To.DistanceTo(y_axis.To) < 0.01:
    origin = x_axis.To
    xvec = -x_axis.Direction
    yvec = -y_axis.Direction
elif x_axis.From.DistanceTo(y_axis.To) < 0.01:
    origin = x_axis.From
    xvec = x_axis.Direction
    yvec = -y_axis.Direction
elif x_axis.To.DistanceTo(y_axis.From) < 0.01:
    origin = x_axis.To
    xvec = -x_axis.Direction
    yvec = y_axis.Direction

plane = rg.Plane(origin, xvec, yvec)
# ---------- end plane ----------

# ----
# Controls
rotate = Slider(0, range=0..360)
shift = Slider(0, range=0..0.3)
t = Slider(85, range=0..180)
element = Button()
element_2 = Button()
aggregate = Button()
human = Button()
reset = Button()
robot = Button()
add = Button()
list = ValueList({"AA", "AB", "BA", "BB"}, selected="BA")
pts = Point([Point(-3.124561898, 0.3619678053, 1.820186629), Point(2.035451837, -1.828229709, 0.1857535972)])

sph = Sphere(Base=pts, Radius=0.05)  # disabled
preview = CustomPreview(Geometry=sph, Material=ColourSwatch(SwatchColor=RGB(255, 92, 92)))  # disabled

# ----
# Design Generation
initial_configuration = GhPythonScript(assembly=elem_def.assembly, elem_x=elem_def.elem_x, elem_y=elem_def.elem_y, elem_z=elem_def.elem_z)  # -> out, assembly, connector_planes, pr, vr
# ---------- initial_configuration: Python ----------
import Rhino.Geometry as rg
import math
from scriptcontext import sticky as st

from compas.geometry import Frame
from compas.geometry import Transformation
from compas.geometry import Rotation, Vector
from compas.geometry import Translation
from compas.geometry import Point

from compas_ghpython import draw_frame
from compas_ghpython.artists import MeshArtist


# just for vizualisation
connector_planes = []

my_elem_x = elem_x.copy()
my_elem_y = elem_y.copy()
my_elem_z = elem_z.copy()

my_elem_x.connector_1_state = False
my_elem_y.connector_1_state = False
my_elem_z.connector_1_state = False
my_elem_y.connector_2_state = False
my_elem_z.connector_2_state = False

my_elem_x.transform(Transformation.from_frame(Frame.worldXY()))
my_elem_y.transform(Transformation.from_frame(Frame.worldXY()))
my_elem_z.transform(Transformation.from_frame(Frame.worldXY()))

assembly.add_element(my_elem_x, elem_type = 'X', placed_by = 'initial', frame_id=None)
assembly.add_element(my_elem_y, elem_type = 'Y', placed_by = 'initial', frame_id=None)
assembly.add_element(my_elem_z, elem_type = 'Z', placed_by = 'initial', frame_id=None)

assembly.network.add_edge(0, 1, edge_of = 'parent')
assembly.network.add_edge(0, 2, edge_of = 'parent')
assembly.network.add_edge(1, 2, edge_of = 'parent')


options = assembly.element(1).options_vectors(0.4)


vr=[]
pr=[]

print options
for o, v in options:
    start = assembly.element(0).frame.point
    vr.append(rg.Vector3d(*tuple(v)))
    pr.append(rg.Point3d(o.x, o.y, o.z))


print assembly.connectors(state='open')
# ---------- end initial_configuration ----------
pln_5 = Plane(initial_configuration.connector_planes)

# ----
# Transform Assembly
pt = Point(Point(0.8066418178, -0.2191574706, 0.4222242235))
x_2 = Curve(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)
y = Curve(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)
pl = ConstructPlane(Origin=pt, XAxis=x_2, YAxis=y)
transform = GhPythonScript(assembly=initial_configuration.assembly, transform=Toggle(True), trnsf_plane=pl)  # -> out, assembly
# ---------- transform: Python ----------
from compas.geometry import Frame
from compas.geometry import Transformation

if transform:
    T = Transformation.from_frame_to_frame(Frame.worldXY(), Frame(trnsf_plane.Origin, trnsf_plane.XAxis, trnsf_plane.YAxis))
    assembly.transform(T)
    assembly.network.transform(T)
# ---------- end transform ----------

generate_assembly = GhPythonScript(
    assembly=transform.assembly,
    robot_base_plane=plane,
    angle_threshold=t,
    targets=pts,
    elem_up=element_2,
    elem_down=element,
    reset=reset,
    flip=list,
    shift_value=shift,
    angle=rotate,
    add_two=add,
    robot_adds=robot,
    human_adds=human,
    aggregate=aggregate)  # -> out, assembly, current_key, coll_mesh, tool_planes; inputs robot_base_plane: Plane, targets: list of Point3d
# ---------- generate_assembly: Python ----------
import Rhino.Geometry as rg
import rhinoscriptsyntax as rs
import math
import random
from scriptcontext import sticky as st
import sys

import ghpythonlib.components as ghcomp

from compas.geometry import Frame, Box, Point
from compas.geometry import Vector, Translation, angle_vectors
from compas.datastructures import mesh_offset
from compas.artists import Artist


from compas.rpc import Proxy

tool_planes = []                     # Tool planes
base_planes = [] 
filtered_keys = []
options = []

#bp = robot_base_plane
#robot_base_frame = Frame(bp.Origin, bp.XAxis, bp.YAxis)

L = list(assembly.elements())

def range_filter(options, robot_base_plane):
    ur_range_max = 1.2
    ur_range_min = 0.75
        
    base_point= Point(robot_base_plane.Origin.X, robot_base_plane.Origin.Y, robot_base_plane.Origin.Z)
    filtered_options = []
    for key, elem_origin, option_vector in options:
        v = Vector.from_start_end(elem_origin, base_point)
        dist = v.length
        if ur_range_min <= dist <= ur_range_max:
            filtered_options.append((key, elem_origin, option_vector))
    return filtered_options

def filter_options(all_options, target_points):
    tps = [Point(p.X, p.Y, p.Z) for p in target_points]
    filtered_options = []
    for tp in tps:
        for key, elem_origin, option_vector in all_options:
            v = Vector.from_start_end(elem_origin, tp)
            angle = angle_vectors(option_vector, v, deg=True)
            if angle < angle_threshold:
                filtered_options.append((key, elem_origin, option_vector))
    return filtered_options

all_options = []

for key, element in assembly.elements():
    for origin, vector in element.options_vectors(-0.40):
        all_options.append((key, origin, vector))

assembly.all_options = all_options

filtered_options = filter_options(all_options, targets)
filtered_keys = []
#for option in filtered_options:
#    filtered_keys.append(option[0])
for option in all_options:
    filtered_keys.append(option[0])
    
filtered_keys = list(set(filtered_keys))
print filtered_keys

assembly.current_options = filtered_options


# store data in component
guid = str(ghenv.Component.InstanceGuid)
element_key = "elem_" + guid

if element_key not in st:
    st[element_key] = 0

if reset:
    st[element_key] = 0

if elem_up:
    if st[element_key] < len(filtered_keys) - 1:
        st[element_key] += 1

if elem_down:
    if st[element_key] <= len(filtered_keys) - 1:
        st[element_key] -= 1

    if st[element_key] < 1:
        st[element_key] = 0


current_key = filtered_keys[st[element_key]]
current_elem = assembly.network.node[current_key]['element']


# Robot adds first element
if robot_adds:
    assembly.add_unit_element(current_key, shift_value, angle, placed_by ='robot', on_ground=True, unit_index=0)
    
# Human adds second element element
if human_adds:
    assembly.add_unit_element(current_key, shift_value, angle, placed_by ='human', on_ground=True, unit_index=1)

# Add two elements
if add_two:
    assembly.close_unit(current_key, shift_value, angle, on_ground = False)
    
if aggregate:
    for i in range (20):
        key_index = assembly.network.key_index()
        keys = [key_index[key] for key in assembly.network.nodes()]
        index = random.randint(0, len(keys)-1)
        current_key = keys[index]
        current_elem = assembly.network.node[current_key]['element']
        elem_connector = assembly.element(current_key).connectors(state='open')
        if current_elem.connector_1_state or current_elem.connector_2_state:
            #random_angle = random.uniform(0., 360.)
            random_angle = 0
            assembly.close_unit(current_key, shift_value, random_angle, on_ground = False)
            #assembly.range_filter(base_frame)
        else:
            print 'No open connectors'

key_index = assembly.network.key_index()
keys = [key_index[key] for key in assembly.network.nodes()]
new_keys = keys[-2:]
print(new_keys)

print(assembly.globals)

for key in keys:
    element = assembly.element(key)
    base_planes.append(Artist(element._base_frame).draw())
    tool_planes.append(Artist(element.tool_frame).draw())
    #print key, ':', assembly.network.node_attribute(key, 'elem_type')

"""

#Collision_check test
T = Translation.from_vector([0.1, -0.024 , 0])
new_elem = elem_x.transformed(T)
coll_mesh = Artist(new_elem.mesh).draw()

c = assembly.collision_check(new_elem, tolerance = -0.001)
#print c



### UNSOLVED: Error loading compas_cgal intersection module's .dll file ###

collision_func = Proxy('assembly_information_model.assembly.collision', python = 'C://Users//lidet//anaconda3//envs//cgal//python.exe')

print collision_func._python

collision_func.stop_server()
collision_func.start_server()

test = collision_func.collision_check_cgal(assembly, new_elem)
print test
"""
# ---------- end generate_assembly ----------
current_key = Panel(generate_assembly.current_key)
mesh_2 = Mesh(generate_assembly.coll_mesh)
pln_6 = Plane(generate_assembly.tool_planes)

# ----
# Network Viz
number_slider = Slider(0, range=0..47)
show_2 = BooleanToggle(False)
network_viz = GhPythonScript(assembly=generate_assembly.assembly, show_network=show_2, key=number_slider)  # -> out, nodes, edges, current_node, current_node_neighbors; inputs key: Int32
# ---------- network_viz: Python ----------
import sys, os
import ghpythonlib.components as ghcomp
from compas.datastructures import Network
from compas_ghpython.artists import NetworkArtist
from compas_rhino.geometry import RhinoLine

import compas_ghpython
import Rhino.Geometry as rg


data = assembly.network.to_data()
network = Network.from_data(data)

print assembly.network.number_of_nodes()

def draw_network(network):
    """Draw a network in Grasshopper.
    """
    points = []
    for key, attr in network.nodes(True):
        points.append({
            'pos': network.node_coordinates(key),
        })

    lines = []
    for (u, v), attr in network.edges(True):
        lines.append({
            'start': network.node_coordinates(u),
            'end': network.node_coordinates(v),
        })

    points_rg = compas_ghpython.draw_points(points)
    lines_rg = compas_ghpython.draw_lines(lines)

    return points_rg, lines_rg

if show_network:
    nodes, edges = draw_network(network)
    
    current_node = {'pos': network.node_coordinates(key), 'radius': 0.03}
    current_node = compas_ghpython.draw_spheres([current_node])
    
    current_node_neighbors_keys = network.neighbors(key)
    current_node_neighbors = [{'pos': network.node_coordinates(key), 'radius': 0.02} for key in current_node_neighbors_keys]
    current_node_neighbors = compas_ghpython.draw_spheres(current_node_neighbors)
# ---------- end network_viz ----------
line = Line(network_viz.edges)
pt_2 = Point(network_viz.nodes)
brep = Brep(network_viz.current_node)
brep_2 = Brep(network_viz.current_node_neighbors)
preview_2 = CustomPreview(Geometry=brep_2, Material=ColourSwatch(SwatchColor=RGB(255, 207, 207)))
preview_3 = CustomPreview(Geometry=[brep, line], Material=ColourSwatch(SwatchColor=RGB(0, 0, 0)))

# ----
# Export .json
export = Button()
export_2 = Button()
py = PythonScript()  # -> HERE, DATA
# ---------- py: Python ----------
import os

HERE = os.path.dirname(ghdoc.Path)
DATA = os.path.abspath(os.path.join(HERE, "..", "data"))
print(HERE)
print(DATA)
# ---------- end py ----------
export_3 = PythonScript(DATA=py.DATA, assembly=generate_assembly.assembly, export_to_json=export, export_to_json_unity=export_2)
# ---------- export_3: Python ----------
import os
from compas.datastructures.mesh import mesh_quads_to_triangles
from compas.datastructures.mesh import mesh_unify_cycles



if export_to_json:
    
    filename = "rsrd_assembly_2_rods.json"
    PATH = os.path.join(DATA, filename)
    
    # the assembly has to be serialized such that it can be called from CPython, True to enable pretty print
    assembly.to_json(PATH, True)
    

if export_to_json_unity:
    
    for key, e in assembly.elements():
    
        #convert to trimesh
        mesh_quads_to_triangles(e._mesh, check_angles=False)
        #mesh_unify_cycles(e._mesh)
        #print e._mesh.faces
        #print e._mesh.face_vertices(list(e._mesh.faces())[0])

    filename = "rsrd_assembly.json"
    PATH = os.path.join(DATA, filename)
    assembly.to_json(PATH)
# ---------- end export_3 ----------

# ----
# Visualization
# 1. Visualize assembly.
# 2. Visualize selected connector.
# 3. Visuilize all options.
# 4. Visuilize filtered options.
show_3 = BooleanToggle(True)
show_4 = BooleanToggle(True)
show_5 = BooleanToggle(False)
show_6 = BooleanToggle(False)
draw_2 = PythonScript(
    assembly=generate_assembly.assembly,
    show_assembly=show_3,
    show_selected=show_4,
    show_all_options=show_5,
    show_filtered_options=show_6,
    current_key=generate_assembly.current_key,
    flip=list,
    shift_value=shift,
    angle=rotate)  # -> out, G_initial, G_built_by_human, G_built_by_robot, G_selected, G_option_human, G_option_robot, connector_planes, pr, vr; inputs current_key: Int32
# ---------- draw_2: Python ----------
import os
import sys
from scriptcontext import sticky as st
import Rhino.Geometry as rg
import rhinoscriptsyntax as rs

import math
from math import pi

from compas.artists import Artist
from compas.geometry import Frame
from compas.geometry import Transformation, Vector, Plane, Translation
from compas.geometry import distance_point_point


connector_planes = []
G_initial = []
G_built_by_human = []
G_built_by_robot = []
G_selected = []
G_option_robot = []
G_option_human = []
vr = []
pr = []

radius = assembly.globals['radius']
#shift_value = assembly.globals['shift_value']



key_index = assembly.network.key_index()
keys = [key_index[key] for key in assembly.network.nodes()]

current_element = assembly.element(current_key)
elem_options = assembly.element(current_key).options_elements(angle)
if len(elem_options) != 0:
    elem_option = elem_options[0]
current_elem_type = current_element._type

robot_keys = list(assembly.network.nodes_where({'placed_by':'robot'}))
human_keys = list(assembly.network.nodes_where({'placed_by':'human'}))
initial_keys = list(assembly.network.nodes_where({'placed_by':'initial'}))

robot_elements = [assembly.element(key) for key in robot_keys] 
human_elements = [assembly.element(key) for key in human_keys] 
initial_elements = [assembly.element(key) for key in initial_keys] 

def show(element, output_geo, color):
    mesh = Artist(element.mesh).draw(color)
    output_geo.append(mesh)

def show_multiple(elements, output_geo, color):
    for element in elements:
        mesh = Artist(element.mesh).draw(color)
        output_geo.append(mesh)

# Get all open connectors 
connectors = assembly.connectors(state = 'open')
# Visualize the open connector planes
connector_planes = [Artist(frame).draw() for elem_connectors in connectors for frame in elem_connectors]

# Visualise assembly
if show_assembly:
    for element in robot_elements:
        mesh = Artist(element.mesh).draw([0.7,0.7,0.7,0.1])
        G_built_by_robot.append(mesh)
    for element in human_elements:
        mesh = Artist(element.mesh).draw([1.,0.7,0.65,0.1])
        G_built_by_human.append(mesh)
    for element in initial_elements:
        mesh = Artist(element.mesh).draw([0.8,0.8,0.8,0.1])
        G_initial.append(mesh)

# Visualise current connector 
# Visualise current connector 
if show_selected:
    #show(current_element, G_selected, [0.3,0.4,1,1])
    if elem_options:
        #show_multiple(elem_options, G_options, [0.8,0.2,0.1,0.1])
        show(elem_options[0], G_option_robot, [0.8,0.2,0.1,0.1])
        show(elem_options[1], G_option_human, [0.6,0.8,0.8,0.5])
    else:
        print('No open connectors')

# Visualize all options
if show_all_options and not show_filtered_options:
    for key, origin, vector in assembly.all_options:
        vr.append(rg.Vector3d(*tuple(vector)))
        pr.append(rg.Point3d(origin.x, origin.y, origin.z))

# Visualize filtered options
if show_filtered_options and not show_all_options:
    for key, o, v in assembly.current_options:
        vr.append(rg.Vector3d(*tuple(v)))
        pr.append(rg.Point3d(o.x, o.y, o.z))
# ---------- end draw_2 ----------
mesh_3 = Mesh(draw_2.G_built_by_human)
mesh_4 = Mesh(draw_2.G_built_by_robot)
mesh_5 = Mesh(draw_2.G_option_human)
mesh_6 = Mesh(draw_2.G_option_robot)
pln_7 = Plane(draw_2.connector_planes)
pt_3 = Point(draw_2.pr)
vec = Vector(draw_2.vr)
mesh_7 = Mesh(draw_2.G_selected)
vdis = VectorDisplay(Anchor=pt_3, Vector=vec)
preview_4 = CustomPreview(Geometry=mesh_6, Material=ColourSwatch(SwatchColor=RGB(255, 92, 92)))
custom_preview_2 = CustomPreview(Geometry=mesh_5, Material=ColourSwatch(SwatchColor=RGBA(178, 219, 212, 164)))
custom_preview_3 = CustomPreview(Geometry=mesh_3, Material=ColourSwatch(SwatchColor=RGB(255, 196, 196)))
custom_preview_4 = CustomPreview(Geometry=mesh_4, Material=ColourSwatch(SwatchColor=RGBA(178, 219, 212, 164)))

mesh_8 = Mesh(draw_2.G_initial)

custom_preview_5 = CustomPreview(Geometry=mesh_8, Material=ColourSwatch(SwatchColor=RGBA(174, 174, 174, 197)))
