# Grasshopper definition ex4_ur_moveit_simulation_playground_wdesigntool.ghx (Grasshopper 1.0.7)

panel = Panel("Unload libraries")
bang = Button()
unload = PythonScript(bang=bang)
# ---------- unload: Python ----------
from compas_rhino.utilities.misc import get_tolerance
from compas_rhino.utilities.misc import unload_modules

unload_modules("robot_see_robot_do")
# ---------- end unload ----------

# ----
# Assembly Definition
# Create an element object.
show = BooleanToggle(False)
globals = GhPythonScript()  # -> out, assembly
# ---------- globals: Python ----------
from robot_see_robot_do.assembly_reciprocal import Assembly

# create assembly
assembly = Assembly()

# create a dictionary to store global value in 
assembly.globals = {}

# define global values
assembly.globals['radius'] = 0.01
assembly.globals['height'] = 1.0
assembly.globals['rf_unit_offset'] = 0.30
assembly.globals['rf_unit_radius'] = 0.1

print assembly.globals
# ---------- end globals ----------
assembly_globals = Panel(globals.out)
elem_def = GhPythonScript(assembly=globals.assembly)  # -> out, assembly, elem
# ---------- elem_def: Python ----------
import os
import sys
import json
import math

from compas.geometry import Frame, Plane, Rotation, Vector
from compas.geometry import Circle, Cylinder, Translation
from compas.artists import Artist

from robot_see_robot_do.assembly_reciprocal import Element

rf_unit_offset = assembly.globals['rf_unit_offset']
rf_unit_radius = assembly.globals['rf_unit_radius']
radius = assembly.globals['radius']
height = assembly.globals['height']

cross_section_plane = Plane.from_frame(Frame.worldYZ())
cross_section = Circle(cross_section_plane, radius)
elem_geo = Cylinder(cross_section, height)

elem = Element.from_shape(elem_geo, Frame.worldXY())
# ---------- end elem_def ----------
draw = PythonScript(elements=elem_def.elem, show=show)  # -> M, F, C; inputs elements: list
# ---------- draw: Python ----------
from compas.artists import Artist

M = []
C = []
F = []
T = []
connectors = []

if show:
    for elem in elements:
        connectors.append(elem.connector_frame_1)
        connectors.append(elem.connector_frame_2)
        M += [Artist(elem._mesh).draw([0,0,1,1])]
        #C += [Artist(frame).draw() for frame in connectors]
        F += [Artist(elem.frame).draw()]
        T += [Artist(elem.tool_frame).draw()]
# ---------- end draw ----------
mesh = Mesh(draw.M)
pln = Plane(draw.F)
pln_2 = Plane(draw.C)
custom_preview = CustomPreview(Geometry=mesh, Material=ColourSwatch(SwatchColor=RGB(221, 0, 0)))

disconnect = Button()
connect = Button()

# ----
# Load robot from local package
list = ValueList({"ur_description", "ur_e_description", "ur_setups"}, selected="ur_e_description")
list_2 = ValueList({"ur3.urdf", "ur3_rot.urdf", "ur5.urdf", "ur10.urdf", "ur3e.urdf", "ur5e.urdf", "ur10e.urdf", "ur10e_rot.urdf"}, selected="ur10e_rot.urdf")
list_3 = ValueList({"ur3.srdf", "ur5.srdf", "ur10.srdf", "ur3e.srdf", "ur5e.srdf", "ur10e.srdf"}, selected="ur10e.srdf")
py = PythonScript()  # -> DATA
# ---------- py: Python ----------
import os
import getpass

HERE = os.path.dirname(ghdoc.Path)
DATA = os.path.abspath(os.path.join(HERE, "..", "data\models"))
print(DATA)
# ---------- end py ----------
py_2 = PythonScript(data_path=py, package=list, urdf_name=list_2, srdf_name=list_3)  # -> loaders, urdf_filename, srdf_filename
# ---------- py_2: Python ----------
import os
from compas.robots import LocalPackageMeshLoader

path = os.path.join(data_path, "robot_description")

#loaders
packages = ["ur_description", "ur_e_description", "ur_end_effectors", "ur_setups"]
loaders = [LocalPackageMeshLoader(path, pck) for pck in packages]

#files
package_path = os.path.join(path, package)
print package_path

urdf_filename = os.path.join(package_path, "urdf", urdf_name)
srdf_filename = os.path.join(package_path, srdf_name)

assert os.path.isfile(urdf_filename)
assert os.path.isfile(srdf_filename)
# ---------- end py_2 ----------

y_axis = Curve(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)
x_axis = Curve(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)
plane = PythonScript(plane_axes=[x_axis, y_axis])  # -> plane; inputs plane_axes: list of Curve
# ---------- plane: Python ----------
import Rhino.Geometry as rg

x_axis, y_axis = plane_axes

x_axis = rg.Line(x_axis.PointAtStart, x_axis.PointAtEnd)
y_axis = rg.Line(y_axis.PointAtStart, y_axis.PointAtEnd)

if x_axis.From.DistanceTo(y_axis.From) < 0.01:
    origin = x_axis.From
    xvec = x_axis.Direction
    yvec = y_axis.Direction
elif x_axis.To.DistanceTo(y_axis.To) < 0.01:
    origin = x_axis.To
    xvec = -x_axis.Direction
    yvec = -y_axis.Direction
elif x_axis.From.DistanceTo(y_axis.To) < 0.01:
    origin = x_axis.From
    xvec = x_axis.Direction
    yvec = -y_axis.Direction
elif x_axis.To.DistanceTo(y_axis.From) < 0.01:
    origin = x_axis.To
    xvec = -x_axis.Direction
    yvec = y_axis.Direction

plane = rg.Plane(origin, xvec, yvec)
# ---------- end plane ----------

brep = Geometry(<brep referenced from the Rhino model>)
mesh_2 = Mesh(brep)
mesh_3 = PythonScript(mesh=mesh_2)  # -> compas_mesh
# ---------- mesh_3: Python ----------
from compas.datastructures import Mesh
from compas_rhino.geometry import RhinoMesh

compas_mesh = RhinoMesh.from_guid(mesh).to_compas()
# ---------- end mesh_3 ----------

# ----
# Controls
reset = Button()
rotate2 = Slider(269.15, range=0..360)
t = Slider(85, range=0..180)
human_adds = Button()
robot_adds = Button()
aggregate = Button()
element = Button()
element_2 = Button()
add_two = Button()
list_4 = ValueList({"AA", "AB", "BA", "BB"}, selected="AA")
pts = Point([Point(0.6575132187, 2.950100609, 1.820186629), Point(3.312696095, 1.886344314, 0.1857535972)])
angle1 = Number(120)

show_picking_frame = BooleanToggle(True)
show_origin_frame = BooleanToggle(True)
show_in_world = BooleanToggle(True)
show_bcm = BooleanToggle(True)
show_cm = BooleanToggle(True)

# ---- group: ROS client
list_5 = ValueList({"local": 0, "linux computer": 1}, selected="local")

# ----
connect_2 = PythonScript(ip=list_5, connect=connect, disconnect=disconnect)  # -> out, ros_client
# ---------- connect_2: Python ----------
import sys
import scriptcontext as sc
from compas_fab.backends import RosClient

key = 'rosclient_%s' % str(ghenv.Component.InstanceGuid)
previous_client = sc.sticky.get(key, None)

if previous_client and (connect or disconnect):
    previous_client.close()

if connect:
    if ip == 0: #local, own laptop
        ros_client = RosClient('127.0.0.1', 9090)
    elif ip == 1: # linux computer
        ros_client = RosClient('10.181.163.92', 9090)
    sc.sticky[key] = ros_client
    ros_client.run(5)

ros_client = sc.sticky.get(key, None)
print('ROS connected: {}'.format(ros_client.is_connected if ros_client else 'False'))
# ---------- end connect_2 ----------

# ---- group: ROS client (continued)
is_connected = Panel(connect_2.out)
ros_client = Data(connect_2.ros_client)

# ----
# Robot
units = ValueList({"m": 1, "cm": 100, "mm": 1000}, selected="m")
load = Button()
create = PythonScript(load=load, loaders=py_2.loaders, urdf_filename=py_2.urdf_filename, srdf_filename=py_2.srdf_filename, scale_factor=units)  # -> out, robot; inputs load: Boolean, loaders: list
# ---------- create: Python ----------
import os
from scriptcontext import sticky as st

import compas

from compas.robots import RobotModel
from compas.robots import LocalPackageMeshLoader

#from compas_fab.robots import Robot
from robot_see_robot_do.robot import Robot
from compas_fab.robots import RobotSemantics

from compas_fab.ghpython import RobotArtist

compas.PRECISION = '12f'

# store robot in component
guid = str(ghenv.Component.InstanceGuid)
robot_key = "robot_" + guid

if robot_key not in st:
    st[robot_key] = None

print loaders
if load:
    model = RobotModel.from_urdf_file(urdf_filename)
    
    model.load_geometry(*loaders)
    artist = RobotArtist(model)
    semantics = RobotSemantics.from_srdf_file(srdf_filename, model)
    robot = Robot(model, artist, semantics, client=None)

    
    st[robot_key] = robot

robot = st[robot_key]


if robot:
    robot.scale(scale_factor)
# ---------- end create ----------
set = PythonScript(robot=create.robot, client=ros_client)  # -> robot
# ---------- set: Python ----------
if robot and client:
    robot.client = client
# ---------- end set ----------
robot = Data(set)

# ----
# Base
x_axis_2 = Curve(<curve referenced from the Rhino model>)
y_axis_2 = Curve(<curve referenced from the Rhino model>)
x_axis_3 = Curve(<curve referenced from the Rhino model>)
y_axis_3 = Curve(<curve referenced from the Rhino model>)
plane_2 = PythonScript(plane_axes=[x_axis_2, y_axis_2])  # -> plane; inputs plane_axes: list of Curve; same code as plane
plane_3 = PythonScript(plane_axes=[x_axis_3, y_axis_3])  # -> plane; inputs plane_axes: list of Curve; same code as plane
breps = Geometry([<brep referenced from the Rhino model> x39])
base = PythonScript(base_plane=plane_2, pickup_plane=plane_3)  # -> base_frame, picking_frame
# ---------- base: Python ----------
from compas.geometry import Frame
from compas.geometry import Transformation, Rotation
from compas_ghpython import draw_frame
import math
import Rhino.Geometry as rg



base_frame = Frame(base_plane.Origin, base_plane.XAxis, base_plane.YAxis)

picking_frame = Frame(pickup_plane.Origin, pickup_plane.XAxis, pickup_plane.YAxis)
# ---------- end base ----------
py_3 = PythonScript(
    robot=robot,
    origin_frame=base.base_frame,
    base_geometry=breps,
    picking_frame=base.picking_frame,
    set_to_origin_frame=Toggle(True))  # -> a, picking_plane_WCF; inputs base_geometry: list, set_to_origin_frame: Boolean
# ---------- py_3: Python ----------
from compas_ghpython import draw_frame
from compas.geometry import Frame, Point, Vector, Transformation
from compas.datastructures import Mesh
from compas_rhino.geometry import RhinoMesh
from compas_fab.robots import CollisionMesh



if set_to_origin_frame == True:
    robot.set_origin_frame(origin_frame)
else:
    robot.set_origin_frame(Frame.worldXY())

if len(base_geometry):
    robot.set_base_geometry(base_geometry)

if picking_frame:
    picking_frame_WCF = robot.to_world_coordinates_origin(picking_frame)
    robot.set_picking_frame(picking_frame_WCF)
    picking_plane_WCF = draw_frame(picking_frame_WCF)
# ---------- end py_3 ----------

# ----
# Tool
panel_2 = Panel("Attach a custom tool")
list_6 = ValueList({"measurement_tip": 0, "air_pick_15mm": 1, "area_gripper": 2, "parallel_gripper": 3}, selected="measurement_tip")
show_2 = BooleanToggle(False)
python = PythonScript(data_path=py, tool=list_6, show=show_2)  # -> tool, M, compas_mesh
# ---------- python: Python ----------
import os, math
from compas.geometry import Frame, Rotation
from compas.datastructures import Mesh
from compas_ghpython.artists import MeshArtist
from compas_fab.robots import Tool

tolerance = 0


#if tool == 0:
#    filename = 'measurement_tool_zaxis.stl'
#    ee_frame = Frame([0, 0, 0.109], [1, 0, 0], [0, 1, 0])
    
if tool == 0:
    filename = 'measurement_tip_zaxis.stl'
    ee_frame = Frame([0, 0, 0.1680], [1, 0, 0], [0, 1, 0])

elif tool == 1:
    filename = 'airpick_15.stl'
    ee_frame = Frame([0, 0, 0.158 + tolerance], [1, 0, 0], [0, 1, 0])
    
elif tool == 2:
    filename = 'area_gripper_zaxis.stl'
    ee_frame = Frame([0, 0, 0.10219 + tolerance], [1, 0, 0], [0, 1, 0])

elif tool == 3:
    filename = 'parallel_gripper_iaac.stl'
    ee_frame = Frame([0, 0, 0.1135 + tolerance], [1, 0, 0], [0, 1, 0])    
    
data_path = os.path.join(data_path, "tool_geometry")
fullfilename = os.path.join(data_path, filename)
print fullfilename

ee_mesh = Mesh.from_stl(fullfilename)

#R = Rotation.from_axis_and_angle(ee_frame.zaxis, math.radians(180), point=ee_frame.point)
#ee_frame.transform(R)

if show:
    artist = MeshArtist(ee_mesh)
    M = artist.draw()

tool = Tool(ee_mesh, ee_frame)
compas_mesh = ee_mesh
# ---------- end python ----------
py_4 = PythonScript(robot=robot, tool=python.tool, attach=Toggle(True))  # -> a
# ---------- py_4: Python ----------
if attach:
    robot.attach_tool(tool)
else:
    robot.detach_tool()
# ---------- end py_4 ----------

# ----
# Planning scene
scene = PythonScript(robot=robot)  # -> scene
# ---------- scene: Python ----------
from scriptcontext import sticky as st

from compas_fab.robots import PlanningScene

# store scene in component
guid = str(ghenv.Component.InstanceGuid)
scene_key = "scene_" + guid

if scene_key not in st:
    st[scene_key] = None

if robot:
    scene = PlanningScene(robot)
    scene.cm = []
    scene.acm = []
    scene.bcm = None
    st[scene_key] = scene

scene = st[scene_key]
# ---------- end scene ----------

panel_3 = Panel("base collision mesh")
remove = Button()
scale = BooleanToggle(False)
add = Button()
collision = PythonScript(robot=robot, scene=scene, compas_mesh=mesh_3, scale=scale, id="base_cm", add=add, remove=remove)  # -> out, a
# ---------- collision: Python ----------
from compas_fab.robots import CollisionMesh


cm = CollisionMesh(compas_mesh, id)


if scene:
    if add:
        scene.add_collision_mesh(cm, scale)
        scene.bcm = cm
    if remove:
        scene.remove_collision_mesh(id)
        scene.bcm = None
# ---------- end collision ----------
panel_4 = Panel(collision.out)

# ----
# Info
info = PythonScript(robot=robot)  # -> out, main_group_name
# ---------- info: Python ----------
if robot:
    robot.info()
    main_group_name = robot.main_group_name
# ---------- end info ----------
panel_5 = Panel(info.out)

# ---- group: forward kinematics
a1 = Slider(0, range=-360..360)
a2 = Slider(-90, range=-360..360)
a3 = Slider(90, range=-360..360)
a4 = Slider(-90, range=-360..360)
a5 = Slider(-90, range=-360..360)
a6 = Slider(90, range=-360..360)
jp = GhPythonScript()  # -> joint_positions
# ---------- jp: Python ----------
import math

joint_positions = [0,-90,90,-90,-90,90]
joint_positions = [math.radians(a) for a in joint_positions]
#joint_positions = [-3.136, -0.328, -1.218, 3.129, 0.852, 0.008]
#joint_positions = [0] * 6

print joint_positions
# ---------- end jp ----------
forward_kinematics = PythonScript(robot=robot, set_joint_positions=Button(), joint_positions=jp, a1=a1, a2=a2, a3=a3, a4=a4, a5=a5, a6=a6)  # -> full_configuration; inputs joint_positions: list
# ---------- forward_kinematics: Python ----------
import math
import Grasshopper
from compas.robots import Joint
from compas_fab.robots import Configuration

if set_joint_positions:

    j = 0
    for i in range(ghenv.Component.Params.Input.Count):
        nslider = ghenv.Component.Params.Input[i].Sources[0]
        if nslider.GetType() == Grasshopper.Kernel.Special.GH_NumberSlider:
            nslider.TrySetSliderValue(math.degrees(joint_positions[j]))
            j += 1

if robot:
    joint_positions = [a1, a2, a3, a4, a5, a6]
    joint_types = robot.get_configurable_joint_types()
    for i, joint_type in enumerate(joint_types):
        if joint_type == Joint.REVOLUTE:
            joint_positions[i] = math.radians(joint_positions[i])
    full_configuration = Configuration(joint_positions, joint_types)

print(full_configuration)
# ---------- end forward_kinematics ----------

# ----
# Design Generation
initial_configuration = GhPythonScript(assembly=elem_def.assembly, elem=elem_def.elem)  # -> out, assembly, connector_planes
# ---------- initial_configuration: Python ----------
import Rhino.Geometry as rg
import math
from scriptcontext import sticky as st

from compas.geometry import Frame, Vector
from compas.geometry import Rotation, Translation, Transformation
from compas.geometry import Point
from compas.artists import Artist


# just for vizualisation
connector_planes = []

radius = assembly.globals['radius']
height = assembly.globals['height']
rf_unit_offset = assembly.globals['rf_unit_offset']
rf_unit_radius = assembly.globals['rf_unit_radius']

T = Translation.from_vector([-rf_unit_offset, rf_unit_radius/2., 0])
elem_1 = elem.transformed(T)

R_elem = Rotation.from_axis_and_angle(elem_1.frame.yaxis, math.radians(-7.2), elem_1.frame.point)
elem_1.transform(R_elem)

connector_frame_1 = Frame.worldXY()
R_conn = Rotation.from_axis_and_angle(elem_1.frame.zaxis, math.radians(180), elem_1.frame.point)
connector_frame_2 = connector_frame_1.transformed(R_conn)

elem_1.connector_frame_1 = connector_frame_1
elem_1.connector_frame_2 = connector_frame_2

R1 = Rotation.from_axis_and_angle(Vector.Zaxis(), math.radians(120), [0,0,0])
R2 = Rotation.from_axis_and_angle(Vector.Zaxis(), math.radians(240), [0,0,0])

elem_2 = elem_1.transformed(R1)
elem_3 = elem_1.transformed(R2)

elem_1.connector_1_state = False
#elem_1.connector_2_state = False

elem_2.connector_1_state = False
elem_2.connector_2_state = False

elem_3.connector_1_state = False
elem_3.connector_2_state = False


assembly.add_element(elem_1, placed_by = 'initial', frame_id=None)
assembly.add_element(elem_2, placed_by = 'initial', frame_id=None)
assembly.add_element(elem_3, placed_by = 'initial', frame_id=None)

assembly.network.add_edge(0, 1, edge_of = 'parent')
assembly.network.add_edge(0, 2, edge_of = 'parent')
assembly.network.add_edge(1, 2, edge_of = 'parent')


options = assembly.element(1).options_vectors(0.4)


vr=[]
pr=[]

print options
for o, v in options:
    start = assembly.element(0).frame.point
    vr.append(rg.Vector3d(*tuple(v)))
    pr.append(rg.Point3d(o.x, o.y, o.z))


print assembly.connectors(state='open')

connector_planes = [Artist(connector).draw() for connectors in assembly.connectors(state='open') for connector in connectors]
# ---------- end initial_configuration ----------
pln_3 = Plane(initial_configuration.connector_planes)

# ----
# Transform Assembly
pt = Point(Point(0.8066418178, -0.2191574706, 0.4222242235))
x = Curve(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)
y = Curve(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)
pl = ConstructPlane(Origin=pt, XAxis=x, YAxis=y)
transform = GhPythonScript(assembly=initial_configuration.assembly, transform=Toggle(True), trnsf_plane=pl)  # -> out, assembly, planes
# ---------- transform: Python ----------
from compas.geometry import Frame
from compas.geometry import Transformation

from compas.artists import Artist

planes = []

if transform:
    T = Transformation.from_frame_to_frame(Frame.worldXY(), Frame(trnsf_plane.Origin, trnsf_plane.XAxis, trnsf_plane.YAxis))
    assembly.transform(T)
    assembly.network.transform(T)
    
    
for key, element in assembly.elements():
    planes.append(Artist(element.frame).draw())
# ---------- end transform ----------

# ----
# Add support
toggle = BooleanToggle(True)
pln_4 = Plane(Plane(origin=(0.8284965546, -0.116329934, 0.3446181635), x=(0.5836778286, 0.5396858127, -0.6066790058), y=(0.6788954185, -0.7342349834, 0)))
support = GhPythonScript(assembly=transform.assembly, add_support=toggle, elem=elem_def.elem, support_plane=pln_4)  # -> out, support_geo, assembly
# ---------- support: Python ----------
from compas.geometry import Frame, Transformation
from compas.artists import Artist

T_support = Transformation.from_frame(Frame(support_plane.Origin, support_plane.XAxis, support_plane.YAxis))
added_support_elem = elem.transformed(T_support)

if add_support:
    support_geo = Artist(added_support_elem.mesh).draw()
# ---------- end support ----------
mesh_4 = Mesh(support.support_geo)

generate_assembly = GhPythonScript(
    assembly=support.assembly,
    robot_base_plane=plane,
    angle_threshold=t,
    targets=pts,
    element_up=element,
    element_down=element_2,
    reset=reset,
    flip=list_4,
    angle1=angle1,
    angle2=rotate2,
    add_two=add_two,
    robot_adds=robot_adds,
    human_adds=human_adds,
    aggregate=aggregate)  # -> out, assembly, current_key, coll_mesh, tool_planes; inputs robot_base_plane: Plane, targets: list of Point3d
# ---------- generate_assembly: Python ----------
import Rhino.Geometry as rg
import rhinoscriptsyntax as rs
import math
import random
from scriptcontext import sticky as st
import sys

import ghpythonlib.components as ghcomp

from compas.geometry import Frame, Box, Point
from compas.geometry import Vector, Translation, angle_vectors
from compas.datastructures import mesh_offset
from compas.artists import Artist


from compas.rpc import Proxy

tool_planes = []                     # Tool planes
filtered_keys = []
#options = []
all_options = []

L = list(assembly.elements())

robot_base_frame = Frame(robot_base_plane.Origin, robot_base_plane.XAxis, robot_base_plane.YAxis)

def range_filter(options, robot_base_plane):
    ur_range_max = 1.2
    ur_range_min = 0.75
        
    robot_base_point= Point(robot_base_plane.Origin.X, robot_base_plane.Origin.Y, robot_base_plane.Origin.Z)
    filtered_options = []
    for key, elem_origin, option_vector in options:
        v = Vector.from_start_end(elem_origin, robot_base_point)
        dist = v.length
        if ur_range_min <= dist <= ur_range_max:
            filtered_options.append((key, elem_origin, option_vector))
    return filtered_options

def filter_options(all_options, target_points):
    tps = [Point(p.X, p.Y, p.Z) for p in target_points]
    filtered_options = []
    for tp in tps:
        for key, elem_origin, option_vector in all_options:
            v = Vector.from_start_end(elem_origin, tp)
            angle = angle_vectors(option_vector, v, deg=True)
            if angle < angle_threshold:
                filtered_options.append((key, elem_origin, option_vector))
    return filtered_options

for key, element in assembly.elements():
    for origin, vector in element.options_vectors(-0.40):
        all_options.append((key, origin, vector))

assembly.all_options = all_options

filtered_options = filter_options(all_options, targets)

#for option in filtered_options:
#    filtered_keys.append(option[0])

for option in all_options:
    filtered_keys.append(option[0])
    
filtered_keys = list(set(filtered_keys))
print 'Filtered keys:', filtered_keys

assembly.current_options = filtered_options

# store data in component
guid = str(ghenv.Component.InstanceGuid)
element_key = "elem_" + guid

if element_key not in st:
    st[element_key] = 0

if reset:
    st[element_key] = 0

if element_up:
    if st[element_key] < len(filtered_keys) - 1:
        st[element_key] += 1

if element_down:
    if st[element_key] <= len(filtered_keys) - 1:
        st[element_key] -= 1

    if st[element_key] < 1:
        st[element_key] = 0

# 
current_key = filtered_keys[st[element_key]]
current_elem = assembly.network.node[current_key]['element']

# Robot adds first element
if robot_adds:
    assembly.add_unit_element(current_key, flip, angle1, angle2, placed_by ='robot', on_ground=False, unit_index=0)
    
# Human adds second element element
if human_adds:
    assembly.add_unit_element(current_key, flip, angle1, angle2, placed_by ='human', on_ground=False, unit_index=1)

# Add two elements
if add_two:
    assembly.close_unit(current_key, flip, angle1, angle2, on_ground = False)

# random growth
if aggregate:
    for i in range (20):
        key_index = assembly.network.key_index()
        keys = [key_index[key] for key in assembly.network.nodes()]
        index = random.randint(0, len(keys)-1)
        current_key = keys[index]
        current_elem = assembly.network.node[current_key]['element']
        elem_connector = assembly.element(current_key).connectors(state='open')
        if current_elem.connector_1_state or current_elem.connector_2_state:
            flip_index = random.randint(0, 3)
            flip = ['AA', 'AB', 'BA', 'BB'][flip_index]
            random_angle1 = random.uniform(0., 360.)
            random_angle2 = random.uniform(0., 360.)
            #random_angle1 = 0
            #random_angle2 = 0
            assembly.close_unit(current_key, flip, random_angle1, random_angle2, on_ground = False)
            #assembly.range_filter(robot_base_frame)
        else:
            print 'No open connectors'

key_index = assembly.network.key_index()
keys = [key_index[key] for key in assembly.network.nodes()]
new_keys = keys[-2:]
print 'Last added keys:', new_keys

for key in keys:
    element = assembly.element(key)
    tool_planes.append(Artist(element.tool_frame).draw())


"""
#Collision_check test
T = Translation.from_vector([0.1, -0.024 , 0])
new_elem = elem_x.transformed(T)
coll_mesh = Artist(new_elem.mesh).draw()

c = assembly.collision_check(new_elem, tolerance = -0.001)
#print c


### UNSOLVED: Error loading compas_cgal intersection module's .dll file ###

collision_func = Proxy('assembly_information_model.assembly.collision', python = 'C://Users//lidet//anaconda3//envs//cgal//python.exe')

print collision_func._python

collision_func.stop_server()
collision_func.start_server()

test = collision_func.collision_check_cgal(assembly, new_elem)
print test
"""
# ---------- end generate_assembly ----------
current_key = Panel(generate_assembly.current_key)
status_update = Panel(generate_assembly.out)
mesh_5 = Mesh(generate_assembly.coll_mesh)
pln_5 = Plane(generate_assembly.tool_planes)

# ----
# Visualization
# 1. Visualize assembly.
# 2. Visualize selected connector.
# 3. Visuilize all options.
# 4. Visuilize filtered options.
show_3 = BooleanToggle(True)
show_4 = BooleanToggle(True)
show_5 = BooleanToggle(True)
show_6 = BooleanToggle(False)
draw_2 = PythonScript(
    assembly=generate_assembly.assembly,
    show_assembly=show_3,
    show_selected=show_4,
    show_all_options=show_5,
    show_filtered_options=show_6,
    current_key=generate_assembly.current_key,
    flip=list_4,
    angle1=angle1,
    angle2=rotate2)  # -> out, G_initial, G_built_by_human, G_built_by_robot, G_selected, G_option_human, G_option_robot, connector_planes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; inputs current_key: Int32
# ---------- draw_2: Python ----------
import os
import sys
from scriptcontext import sticky as st
import Rhino.Geometry as rg

import math
from math import pi

from compas.artists import Artist

connector_planes = []
G_initial = []
G_built_by_human = []
G_built_by_robot = []
G_selected = []
G_option_robot = []
G_option_human = []
vr = []
pr = []

radius = assembly.globals['radius']

def show(element, output_geo, color):
    mesh = Artist(element.mesh).draw(color)
    output_geo.append(mesh)

def show_multiple(elements, output_geo, color):
    for element in elements:
        mesh = Artist(element.mesh).draw(color)
        output_geo.append(mesh)
        

current_element = assembly.element(current_key)
elem_options = assembly.element(current_key).options_elements(flip, angle1, angle2)

if len(elem_options) != 0:
    elem_option = elem_options[0]

robot_keys = list(assembly.network.nodes_where({'placed_by':'robot'}))
human_keys = list(assembly.network.nodes_where({'placed_by':'human'}))
initial_keys = list(assembly.network.nodes_where({'placed_by':'initial'}))

robot_elements = [assembly.element(key) for key in robot_keys] 
human_elements = [assembly.element(key) for key in human_keys] 
initial_elements = [assembly.element(key) for key in initial_keys] 

# Visualize the open connector planes
connector_planes = [Artist(frame).draw() for elem_connectors in assembly.connectors(state = 'open') for frame in elem_connectors]

# Visualise assembly
if show_assembly:
    for element in robot_elements:
        mesh = Artist(element.mesh).draw([0.7,0.7,0.75,0.1])
        G_built_by_robot.append(mesh)
    for element in human_elements:
        mesh = Artist(element.mesh).draw([1.,0.7,0.65,0.1])
        G_built_by_human.append(mesh)
    for element in initial_elements:
        mesh = Artist(element.mesh).draw([0.8,0.8,0.8,0.1])
        G_initial.append(mesh)

# Visualise current connector 
if show_selected:
    if elem_options:
        show(elem_options[0], G_option_robot, [0.7,0.9,0.9,0.8])
        show(elem_options[1], G_option_human, [0.8,0.2,0.1,0.1])
    else:
        print('No open connectors')

# Visualize all options
if show_all_options and not show_filtered_options:
    for key, origin, vector in assembly.all_options:
        vr.append(rg.Vector3d(*tuple(vector)))
        pr.append(rg.Point3d(origin.x, origin.y, origin.z))

# Visualize filtered options
if show_filtered_options and not show_all_options:
    for key, o, v in assembly.current_options:
        vr.append(rg.Vector3d(*tuple(v)))
        pr.append(rg.Point3d(o.x, o.y, o.z))

elem_option_robot = elem_options[0] # elem for planning robot routine
# ---------- end draw_2 ----------
mesh_6 = Mesh(draw_2.G_initial)
mesh_7 = Mesh(draw_2.G_built_by_human)
mesh_8 = Mesh(draw_2.G_selected)
pt_2 = Point(draw_2.pr)
vec = Vector(draw_2.vr)
mesh_9 = Mesh(draw_2.G_built_by_robot)
mesh_10 = Mesh(draw_2.G_option_human)
mesh_11 = Mesh(draw_2.G_option_robot)
pln_6 = Plane(draw_2.connector_planes)
vdis = VectorDisplay(Anchor=pt_2, Vector=vec)
custom_preview_2 = CustomPreview(Geometry=mesh_6, Material=ColourSwatch(SwatchColor=RGBA(189, 189, 189, 197)))
custom_preview_3 = CustomPreview(Geometry=mesh_7, Material=ColourSwatch(SwatchColor=RGB(255, 196, 196)))
custom_preview_4 = CustomPreview(Geometry=mesh_9, Material=ColourSwatch(SwatchColor=RGBA(154, 196, 212, 164)))
preview = CustomPreview(Geometry=mesh_10, Material=ColourSwatch(SwatchColor=RGB(255, 92, 92)))
custom_preview_5 = CustomPreview(Geometry=mesh_11, Material=ColourSwatch(SwatchColor=RGBA(178, 219, 212, 164)))

mesh_12 = PythonScript(assembly=generate_assembly.assembly)  # -> elems_compas_meshes, elem_compas_mesh
# ---------- mesh_12: Python ----------
from compas.geometry import Frame, Transformation
from compas.artists import Artist

elems_compas_meshes = []

for key, elem in assembly.elements():
    m = elem.mesh
    elems_compas_meshes.append(m)

elem = assembly.element(0)
T = Transformation.from_change_of_basis(Frame.worldXY(), elem.frame)
mesh_transformed = elem.mesh.transformed(T)
elem_compas_mesh = mesh_transformed
# ---------- end mesh_12 ----------

panel_6 = Panel("assembly collision mesh")
remove_2 = Button()
add_2 = Button()
collision_2 = PythonScript(robot=robot, scene=scene, compas_meshes=mesh_12.elems_compas_meshes, add=add_2, remove=remove_2)  # -> out, a; inputs compas_meshes: list
# ---------- collision_2: Python ----------
from compas_fab.robots import CollisionMesh



T = robot.transformation_WCF_OCF()

cms_OCF = []
for i, compas_mesh in enumerate(compas_meshes):
    id = 'element_' + str(i)
    compas_mesh_OCF = compas_mesh.transformed(T)
    cm_OFC = CollisionMesh(compas_mesh_OCF, id)
    cms_OCF.append(cm_OFC)


if scene:
    if add:
        for cm in cms_OCF:
            scene.add_collision_mesh(cm)
            scene.cm.append(cm)
    if remove:
        for cm in cms_OCF:
            scene.remove_collision_mesh(id)
            scene.cm.remove(scene.cm[-1])
# ---------- end collision_2 ----------
panel_7 = Panel(collision_2.out)

# ----
# Attach an collision object
# Select link name to attach
# Select the links the object is allowed to touch
number_slider = Slider(7, range=0..7)
idxs = Data([3, 4, 5, 6, 7])
py_5 = PythonScript(robot=robot, idx=number_slider)  # -> link_name; inputs idx: Int32
# ---------- py_5: Python ----------
if robot:
    link_names = robot.get_link_names()
    #print link_names
    link_name = link_names[idx]
# ---------- end py_5 ----------
panel_8 = Panel(py_5)
py_6 = PythonScript(robot=robot, idxs=idxs)  # -> touch_links; inputs idxs: list of Int32
# ---------- py_6: Python ----------
if robot:
    link_names = robot.get_link_names()
    touch_links = [link_names[i] for i in idxs]
# ---------- end py_6 ----------
panel_9 = Panel(py_6)
remove_3 = Button()
scale_2 = BooleanToggle(False)
add_3 = Button()
attached = PythonScript(
    scene=scene,
    compas_mesh=mesh_12.elem_compas_mesh,
    scale=scale_2,
    id="tip",
    link_name=py_5,
    touch_links=py_6,
    add=add_3,
    remove=remove_3)  # -> acm, out; inputs touch_links: list
# ---------- attached: Python ----------
from compas_fab.robots import CollisionMesh
from compas_fab.robots import AttachedCollisionMesh

cm = CollisionMesh(compas_mesh, id)
acm = AttachedCollisionMesh(cm, link_name, touch_links)

if scene:
    if add:
        scene.add_attached_collision_mesh(acm, scale)
        scene.acm.append(acm)
    if remove:
        scene.remove_attached_collision_mesh(id)
        scene.remove_collision_mesh(id)
        scene.acm.remove(scene.acm[-1])
# ---------- end attached ----------

python_2 = GhPythonScript(robot=robot, element=draw_2.elem_option_robot, rotation_angle=Slider(50, range=-90..90))  # -> out, picking_plane_WCF, placing_plane_WCF
# ---------- python_2: Python ----------
import math
from compas.geometry import Frame, Transformation
from compas_ghpython import draw_frame
import Rhino.Geometry as rg

picking_frame_WCF = robot.get_picking_frame()
picking_plane_WCF = draw_frame(picking_frame_WCF)

placing_frame_WCF = element.tool_frame
placing_plane_WCF = draw_frame(placing_frame_WCF)
placing_plane_WCF.Rotate(math.radians(rotation_angle), placing_plane_WCF.XAxis)
# ---------- end python_2 ----------

# ----
# Input
panel_10 = Panel("Start plane")
pt_3 = Point(Point(0.62116715, 0.5299532239, 0.7918306328))
pt_4 = Point(Point(0.4148048473, 0.0806959495, 0.584079725))
panel_11 = Panel("End plane")
py_7 = GhPythonScript(pt=pt_4)  # -> pln
# ---------- py_7: Python ----------
import Rhino.Geometry as rg

pln = rg.Plane(pt, -rg.Vector3d.ZAxis)
# ---------- end py_7 ----------
py_8 = GhPythonScript(pt=pt_3)  # -> pln; same code as py_7
end_plane = Plane(python_2.placing_plane_WCF)
start_plane = Plane(python_2.picking_plane_WCF)

# ----
# Network Viz
number_slider_2 = Slider(0, range=0..47)
show_7 = BooleanToggle(False)
network_viz = GhPythonScript(assembly=generate_assembly.assembly, show_network=show_7, key=number_slider_2)  # -> out, nodes, edges, current_node, current_node_neighbors; inputs key: Int32
# ---------- network_viz: Python ----------
import sys, os
import ghpythonlib.components as ghcomp
from compas.datastructures import Network
from compas_ghpython.artists import NetworkArtist
from compas_rhino.geometry import RhinoLine

import compas_ghpython
import Rhino.Geometry as rg


data = assembly.network.to_data()
network = Network.from_data(data)

print assembly.network.number_of_nodes()

def draw_network(network):
    """Draw a network in Grasshopper.
    """
    points = []
    for key, attr in network.nodes(True):
        points.append({
            'pos': network.node_coordinates(key),
        })

    lines = []
    for (u, v), attr in network.edges(True):
        lines.append({
            'start': network.node_coordinates(u),
            'end': network.node_coordinates(v),
        })

    points_rg = compas_ghpython.draw_points(points)
    lines_rg = compas_ghpython.draw_lines(lines)

    return points_rg, lines_rg

if show_network:
    nodes, edges = draw_network(network)
    
    current_node = {'pos': network.node_coordinates(key), 'radius': 0.03}
    current_node = compas_ghpython.draw_spheres([current_node])
    
    current_node_neighbors_keys = network.neighbors(key)
    current_node_neighbors = [{'pos': network.node_coordinates(key), 'radius': 0.02} for key in current_node_neighbors_keys]
    current_node_neighbors = compas_ghpython.draw_spheres(current_node_neighbors)
# ---------- end network_viz ----------
pt_5 = Point(network_viz.nodes)
line = Line(network_viz.edges)
brep_2 = Brep(network_viz.current_node)
brep_3 = Brep(network_viz.current_node_neighbors)
preview_2 = CustomPreview(Geometry=brep_3, Material=ColourSwatch(SwatchColor=RGB(255, 207, 207)))
preview_3 = CustomPreview(Geometry=[brep_2, line], Material=ColourSwatch(SwatchColor=RGB(0, 0, 0)))

# ----
# Export .json
export = Button()
export_2 = Button()
py_9 = PythonScript()  # -> HERE, DATA
# ---------- py_9: Python ----------
import os

HERE = os.path.dirname(ghdoc.Path)
DATA = os.path.abspath(os.path.join(HERE, "..", "data"))
print(HERE)
print(DATA)
# ---------- end py_9 ----------
export_3 = PythonScript(DATA=py_9.DATA, assembly=generate_assembly.assembly, export_to_json=export, export_to_json_unity=export_2)
# ---------- export_3: Python ----------
import os
from compas.datastructures.mesh import mesh_quads_to_triangles
from compas.datastructures.mesh import mesh_unify_cycles



if export_to_json:
    
    filename = "rsrd_assembly_2_rods.json"
    PATH = os.path.join(DATA, filename)
    
    # the assembly has to be serialized such that it can be called from CPython, True to enable pretty print
    assembly.to_json(PATH, True)
    

if export_to_json_unity:
    
    for key, e in assembly.elements():
    
        #convert to trimesh
        mesh_quads_to_triangles(e._mesh, check_angles=False)
        #mesh_unify_cycles(e._mesh)
        #print e._mesh.faces
        #print e._mesh.face_vertices(list(e._mesh.faces())[0])

    filename = "rsrd_assembly.json"
    PATH = os.path.join(DATA, filename)
    assembly.to_json(PATH)
# ---------- end export_3 ----------

# ----
# Configuration
# TODO Example:
# Add path constraints
main_planning_group = Text(info.main_group_name)
compute = Button()

# ---- group: inverse kinematics
py_10 = PythonScript(robot=robot)  # -> configuration
# ---------- py_10: Python ----------
from compas_fab.robots import Configuration

if robot:
    types = robot.get_configurable_joint_types()
    values = [0] * len(types)
    configuration = Configuration(values, types)
    print configuration
    print robot.get_configurable_joint_names()
# ---------- end py_10 ----------
start_configuration = Data(forward_kinematics)
list_7 = ValueList({"start": 0, "end": 1}, selected="start")
list_8 = ValueList({"0", "1"}, selected="0")
filter = StreamFilter(Gate=list_8, Stream0=start_configuration, Stream1=py_10)
filter_2 = StreamFilter(Gate=list_7, Stream0=start_plane, Stream1=end_plane)
inverse = PythonScript(robot=robot, group=main_planning_group, start_configuration=filter, plane=filter_2, compute=Toggle(True))  # -> out, configuration
# ---------- inverse: Python ----------
import scriptcontext as sc
import logging

from compas.geometry import Frame

from compas_fab.backends.ros import RosError
from compas_fab.robots import Configuration

LOGGER = logging.getLogger('roslibpy')

frame_WCF = Frame(plane.Origin, plane.XAxis, plane.YAxis)
frame_OCF = robot.to_local_coordinates_origin(frame_WCF) # express within the robot frame
if robot.attached_tool:
    frame_OCF = robot.from_tcf_to_t0cf([frame_OCF])[0]

if robot:
    if robot.client and compute:
        if robot.client.is_connected:
            configuration = robot.inverse_kinematics(frame_OCF, start_configuration, group)
            print(configuration)
        else:
            print("Robot is not connected")
# ---------- end inverse ----------
panel_12 = Panel(inverse.out)

# ---- group: forward kinematics
forward = PythonScript(robot=robot, group=main_planning_group, full_configuration=forward_kinematics)  # -> out, frame_WCF
# ---------- forward: Python ----------
"""Calculate the robot's forward kinematic.
    Inputs:
        robot: :class:`compas_fab.robots.Robot`
            The robot.
        group: str, optional
            The planning group used for calculation. Defaults to the robot's
            main planning group.
        full_configuration : :class:`compas_fab.robots.Configuration`
            The full configuration to calculate the forward kinematic for. If no
            full configuration is passed, the zero-joint state for the other
            configurable joints is assumed.
    Output:
        :class:`Frame`
            The frame in the world coordinate frame (WCF).
"""
from __future__ import print_function
import logging

import compas_fab
print(compas_fab.__version__)

LOGGER = logging.getLogger('roslibpy')

if robot and robot.client and full_configuration:
    if robot.client.is_connected:
        frame_WCF = robot.forward_kinematics(full_configuration, group, options={'backend':'model'})
        #frame_WCF = robot.forward_kinematics(full_configuration, group, backend='model')
        print(frame_WCF)
    else:
        print("Robot is not connected")
# ---------- end forward ----------
panel_13 = Panel(forward.out)

# ---- group: plan motion
# Plan motion
# If you specify the tolerance vector with [360, 1, 1], it means that
#     the frame's y-axis and z-axis are allowed to rotate about the x-axis by an
#     angle of 360 degrees, whereas the x-axis can only change 1 degree.
number_slider_3 = Slider(1, range=1..360)
group = Data(main_planning_group)
list_9 = ValueList({"don't use attached collision mesh": 0, "use attached collision mesh": 1}, selected="use attached collision mesh")
py_11 = PythonScript(robot=robot)  # -> configuration
# ---------- py_11: Python ----------
from compas_fab.robots import Configuration

if robot:
    types = robot.get_configurable_joint_types()
    values = [0] * len(types)

    configuration = Configuration(values, types)
    print configuration
# ---------- end py_11 ----------
python_3 = PythonScript(
    robot=robot,
    group=group,
    goal_plane=end_plane,
    tolerance_position=Slider(0.001, range=0..0.001),
    tolerance_xaxis_deg=number_slider_3,
    tolerance_yaxis_deg=Slider(1, range=1..360),
    tolerance_zaxis_deg=Slider(1, range=1..360))  # -> goal_constraints
# ---------- python_3: Python ----------
import math
from compas.geometry import Frame

frame_WCF = Frame(goal_plane.Origin, goal_plane.XAxis, goal_plane.YAxis)
frame_OCF = robot.to_local_coordinates_origin(frame_WCF)
if robot.attached_tool:
    frame_OCF = robot.from_tcf_to_t0cf([frame_OCF])[0]

tolerances_axes = [math.radians(tolerance_xaxis_deg), math.radians(tolerance_yaxis_deg), math.radians(tolerance_zaxis_deg)]

if robot:
    goal_constraints = robot.constraints_from_frame(frame_OCF, tolerance_position, tolerances_axes, group)
# ---------- end python_3 ----------
start_configuration_2 = Data(inverse.configuration)
list_10 = ValueList({"0", "1"}, selected="0")
list_11 = ValueList({"RRT", "RRT*": "RRTStar", "EST", "PRM": "RPM", "PRM*": "RPMStar", "SPARS"}, selected="RRT")
filter_3 = StreamFilter(Gate=list_10, Stream0=start_configuration_2, Stream1=py_11)
filter_4 = StreamFilter(Gate=list_9, Stream1=attached.acm)
panel_14 = Panel("positions")
panel_15 = Panel("velocities")
panel_16 = Panel("accelerations")
start = Button()
reset_2 = Button()
step = Button()

# ----
plan_motion = PythonScript(
    robot=robot,
    group=group,
    start_configuration=filter_3,
    goal_constraints=python_3,
    planner_id=list_11,
    attached_collision_meshes=filter_4,
    compute=compute)  # -> out, trajectory; inputs goal_constraints: list, attached_collision_meshes: list
# ---------- plan_motion: Python ----------
"""Calculates a motion path.
    Inputs:
        robot: The robot
        group: str, optional
            The planning group used for calculation. Defaults to the robot's
            main planning group.
        start_configuration: :class:`compas_fab.robots.Configuration`, optional
            The robot's full configuration, i.e. values for all configurable
            joints of the entire robot cell, at the starting position. Defaults
            to the all-zero configuration.
        goal_constraints: list of :class:`compas_fab.robots.Constraint`
            The goal to be achieved, defined in a set of constraints.
            Constraints can be very specific, for example defining value domains
            for each joint, such that the goal configuration is included,
            or defining a volume in space, to which a specific robot link (e.g.
            the end-effector) is required to move to.
        planner_id: str
            The name of the algorithm used for path planning. Defaults to 'RRT'.
        attached_collision_meshes: list of :class:`compas_fab.robots.AttachedCollisionMesh`
            Defaults to None.
        compute: bool
            Press to calculate solution.
    Output:
        :class:`compas_fab.robots.JointTrajectory`
            The calculated trajectory.
"""
from __future__ import print_function
import logging
import scriptcontext as sc

guid = str(ghenv.Component.InstanceGuid)
response_key = "response_" + guid
if response_key not in sc.sticky:
    sc.sticky[response_key] = None

LOGGER = logging.getLogger('roslibpy')

if robot and robot.client and start_configuration and compute:
    if robot.client.is_connected:
        
        sc.sticky[response_key] = robot.plan_motion(goal_constraints,
                                                    start_configuration,
                                                    group,
                                                    options={
                                                        'planner_id': str(planner_id),
                                                        'attached_collision_meshes': list(attached_collision_meshes),
                                                    })
    else:
        print("Robot client is not connected.")

trajectory = sc.sticky[response_key]
# ---------- end plan_motion ----------
panel_17 = Panel(plan_motion.out)

# ---- group: plan motion (continued)
vis = PythonScript(response=plan_motion.trajectory)  # -> P, V, A, time
# ---------- vis: Python ----------
from compas_ghpython import list_to_ghtree

if response:

    positions = []
    velocities = []
    accelerations = []
    time_from_start = []

    for p in response.points:
        positions.append(p.positions)
        velocities.append(p.velocities)
        accelerations.append(p.accelerations)
        time_from_start.append(p.time_from_start.seconds)

    P = list_to_ghtree(list(zip(*positions)))
    V = list_to_ghtree(list(zip(*velocities)))
    A = list_to_ghtree(list(zip(*accelerations)))

    time = time_from_start[-1]
    print time
# ---------- end vis ----------
time_s = Panel(vis.time)
prismatic = QuickGraph(vis.P, SortOrder=0)
py_12 = PythonScript(robot=robot, group=group, trajectory=plan_motion.trajectory, in_world=show_in_world)  # -> start_configuration, configurations, full_configurations, frames, planes
# ---------- py_12: Python ----------
from compas.geometry import Transformation
from compas.geometry import Frame
from compas_ghpython import draw_frame
from compas_rhino.conversions import xform_to_rhino

import ghpythonlib.components as ghcomp

joint_positions = []

if in_world:
    T = robot.transformation_OCF_WCF()
else:
    T = Transformation()


if trajectory:
    configurations = trajectory.points
    start_configuration = trajectory.start_configuration
    fraction = trajectory.fraction
    time = trajectory.time_from_start
    full_configurations = [robot.merge_group_with_full_configuration(c, trajectory.start_configuration, group) for c in configurations]
    frames = [robot.forward_kinematics(c, group, options=dict(solver='model')) for c in full_configurations]
    if robot.attached_tool:
        frames = [robot.from_t0cf_to_tcf([frame])[0] for frame in frames]
        
    planes = [draw_frame(frame) for frame in frames]
    planes = ghcomp.Transform(planes, xform_to_rhino(T))
# ---------- end py_12 ----------
pline = PolyLine(Vertices=py_12.planes, Closed=False)
graph = QuickGraph(vis.V, SortOrder=0)
graph_2 = QuickGraph(vis.A, SortOrder=0)
preview_4 = CustomPreview(Geometry=pline, Material=ColourSwatch(SwatchColor=RGB(139, 59, 161)))
counter = CountThroughList(L=py_12.full_configurations, start=start, step=step, reset=reset_2)  # -> item; inputs L: list, start: Boolean
# ---------- counter: Python ----------
from scriptcontext import sticky as st
from compas_ghpython.utilities import update_component


interval = 1

# store data in component
guid = str(ghenv.Component.InstanceGuid)
counter_key = "counter_" + guid
running_key = "running_" + guid

if counter_key not in st:
    st[counter_key] = 0

if running_key not in st:
    st[running_key] = False

if start:
    st[running_key] = True

if step:
    if st[counter_key] < len(L) - 1:
        st[counter_key] += 1
    
if len(L):
    item = L[st[counter_key]]

if st[running_key]:
    if st[counter_key] < len(L) - 1:
        st[counter_key] += 1
        update_component(ghenv, interval)
    else:
        st[counter_key] = 0
        st[running_key] = False
# ---------- end counter ----------

# ----
list_12 = ValueList({"0 forward_kinematics": 0, "1 inverse_kinematics": 1, "2 cartesian motion": 2, "3 free-space motion": 3}, selected="0 forward_kinematics")
filter_5 = StreamFilter(Gate=list_12, Stream0=forward_kinematics, Stream1=inverse.configuration, Stream3=counter)

# ----
# Visualisation
# Select configuration input: from fk, ik, path, or from real robot
show_end_effector_frame = BooleanToggle(True)
show_base_frame = BooleanToggle(False)
show_collision = BooleanToggle(False)
show_frames = BooleanToggle(False)
show_visual = BooleanToggle(True)
show_acm = BooleanToggle(True)
visualize = PythonScript(
    robot=robot,
    group=main_planning_group,
    scene=scene,
    configuration=filter_5,
    redraw=[py_4, py_3.a, collision_2.a, collision.a],
    show_visual=show_visual,
    show_collision=show_collision,
    show_end_effector_frame=show_end_effector_frame,
    show_robot_frames=show_frames,
    show_base_frame=show_base_frame,
    show_origin_frame=show_origin_frame,
    show_picking_frame=show_picking_frame,
    show_cm=show_cm,
    show_bcm=show_bcm,
    show_acm=show_acm,
    in_world=show_in_world)  # -> out, robot, visual, collision_meshes_robot, collision_mesh_base, collision_meshes_obstacles, collision_meshes_attached, frames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; inputs redraw: list, attached_collision_meshes: list
# ---------- visualize: Python ----------
from compas.geometry import Vector
from compas.geometry import Point
from compas.geometry import Transformation
from compas.geometry import Frame
from compas_ghpython.artists import MeshArtist
from compas_fab.robots import Configuration

import ghpythonlib.components as ghcomp
from compas_rhino.conversions import xform_to_rhino


if robot and configuration:
    
    robot.update(configuration, visual=show_visual, collision=show_collision)
    if in_world:
        T = robot.transformation_OCF_WCF()
    else:
        T = Transformation()

    if show_visual:
        visual = robot.artist.draw_visual()
        visual += robot.base_geometry
        visual = ghcomp.Transform(visual, xform_to_rhino(T))

    if show_collision:
        collision_meshes_robot = robot.artist.draw_collision()
        collision_meshes_robot = ghcomp.Transform(collision_meshes_robot, xform_to_rhino(T))
    
    if show_end_effector_frame:
        ee_frame = robot.get_end_effector_frame(group=group, full_configuration=configuration)
        if robot.attached_tool:
            ee_frame = robot.from_t0cf_to_tcf([ee_frame])[0]
        ee_frame = ee_frame.transformed(T)
    
    if show_robot_frames:
        frames = robot.transformed_frames(configuration)
        [f.transform(T) for f in frames]

    if show_base_frame:
        base_frame = robot.get_base_frame(group, configuration)
        base_frame = base_frame.transformed(T)
    
    if show_origin_frame:
        origin_frame = robot.get_origin_frame()

    if show_picking_frame:
        picking_frame = robot.get_picking_frame()
        #picking_frame = picking_frame.transformed(T)
    
    if show_cm:
        M = []
        for cm in scene.cm:
            mesh = cm.mesh
            M.append(MeshArtist(mesh).draw())
        collision_meshes_obstacles = M
        collision_meshes_obstacles = ghcomp.Transform(collision_meshes_obstacles, xform_to_rhino(T))
    
    if show_bcm:
        if scene.bcm:
            collision_mesh_base = MeshArtist(scene.bcm.mesh).draw()
            collision_mesh_base = ghcomp.Transform(collision_mesh_base, xform_to_rhino(T))
    
    if show_acm:
        M = []
        for acm in scene.acm:
            ee_frame = robot.get_end_effector_frame(group=group, full_configuration=configuration)
            if robot.attached_tool:
                ee_frame = robot.from_t0cf_to_tcf([ee_frame])[0]
            T_ee = Transformation.from_frame_to_frame(Frame.worldXY(), ee_frame)
            mesh = acm.collision_mesh.mesh.transformed(T_ee)
            M.append(MeshArtist(mesh).draw())
            
        collision_meshes_attached = M
        collision_meshes_attached = ghcomp.Transform(collision_meshes_attached, xform_to_rhino(T))
# ---------- end visualize ----------
geo = Geometry(visualize.visual)
geo_2 = Geometry(visualize.collision_meshes_robot)
draw_3 = GhPythonScript(
    frames=[visualize.frames, visualize.ee_frame, visualize.base_frame, visualize.origin_frame, visualize.picking_frame],
    scale=Slider(0.2, range=0..1))  # -> P, V, C, W; inputs frames: list
# ---------- draw_3: Python ----------
from System.Drawing import Color
from compas_ghpython.utilities import draw_frame

red = Color.FromArgb(255, 0, 0)
green = Color.FromArgb(0, 255, 0)
blue = Color.FromArgb(0, 0, 255)

P = []
V = []
C = []

scale = float(scale)

for frame in frames:
    if not frame:
        continue
    plane = draw_frame(frame)
    P += [plane.Origin] * 3
    V.append(plane.XAxis * scale)
    V.append(plane.YAxis * scale)
    V.append(plane.ZAxis * scale)
    C += [red, green, blue]

W = 3
# ---------- end draw_3 ----------
preview_5 = CustomPreview(Geometry=geo, Shader=ColourSwatch(SwatchColor=RGB(105, 105, 105)))
vdisex = VectorDisplayEx(Point=draw_3.P, Vector=draw_3.V, Colour=draw_3.C, Width=draw_3.W)

geo_3 = Geometry(visualize.collision_meshes_attached)
geo_4 = Geometry(visualize.collision_mesh_base)
geo_5 = Geometry(visualize.collision_meshes_obstacles)

preview_6 = CustomPreview(Geometry=[geo_2, geo_5, geo_3, geo_4], Shader=ColourSwatch(SwatchColor=RGB(108, 79, 255)))
