# Grasshopper definition ex5_scanning_example.ghx (Grasshopper 1.0.7)

# ----
# 1.
# Load initial assembly
# Import initial assembly (first rf unit)
import = Button(ExpressionNormal="True", ExpressionPressed="False")
py = PythonScript(import_from_json=import)  # -> HERE, DATA, import_from_json
# ---------- py: Python ----------
import os
from scriptcontext import sticky as st

HERE = os.path.dirname(ghdoc.Path)
DATA = os.path.abspath(os.path.join(HERE, "..", "data"))
print(HERE)
print(DATA)

st.clear()
st['DATA_PATH'] = DATA
# ---------- end py ----------
initial_assembly = GhPythonScript(DATA=py.DATA, import_from_json=py.import_from_json)  # -> out, assembly; inputs import_from_json: Boolean
# ---------- initial_assembly: Python ----------
import os
import json
from scriptcontext import sticky

from robot_see_robot_do.assembly_reciprocal import Assembly

if import_from_json:
    filename = "rsrd_assembly_2_rods.json"
    PATH = os.path.join(DATA, filename)
    assembly = Assembly.from_json(PATH)


#assembly.network.delete_node(6)

if assembly:
    counter = 1
    """
    for key, elem, data in assembly.elements(data=True):
        data['frame_id'] = counter
        counter +=1
    """
    sticky['assembly'] = assembly
    
    
# create a dictionary to store global value in 
assembly.globals = {}

# define global values
assembly.globals['radius'] = 0.01
assembly.globals['height'] = 1.0
assembly.globals['rf_unit_offset'] = 0.30
assembly.globals['rf_unit_radius'] = 0.1

print assembly.globals
# ---------- end initial_assembly ----------

# ----
# QR Code
number_slider = Slider(0.09, range=0..0.1)
pt = Point(Point(0.455, -0.545, 0))
xy = XYPlane(Origin=pt)
rectangle = Rectangle(Plane=xy, XSize=number_slider, YSize=number_slider, Radius=0)  # -> Rectangle, Length

# ----
# ROS - Settings
list = ValueList({"local": 0, "backpack computer": 1}, selected="backpack computer")

panel = Panel("Unload libraries")
bang = Button()
unload = PythonScript(bang=bang)
# ---------- unload: Python ----------
from compas_rhino.utilities.misc import get_tolerance
from compas_rhino.utilities.misc import unload_modules

unload_modules("roslibpy")
unload_modules("robot_see_robot_do")
# ---------- end unload ----------

# ---- group: ROS client
restart = Button()
disconnect = Button()
connect = Button()
ros = PythonScript(restart=restart, connection=list)  # -> ros_client
# ---------- ros: Python ----------
import time
import logging
import scriptcontext as sc

from roslibpy import Ros
from System import TimeSpan
from System.Threading import ManualResetEventSlim

LOGGER = logging.getLogger('roslibpy')

guid = str(ghenv.Component.InstanceGuid)
ros_client_key = "rosclient_" + guid

previous_client = sc.sticky.get(ros_client_key, None)
if previous_client:
    previous_client.terminate()

if connection == 0: #local
    ros_client = Ros('127.0.0.1', 9090) #local, own laptop
elif connection == 1: # backpack computer
    ros_client = Ros('172.20.10.5', 9090) #172.20.10.5
sc.sticky[ros_client_key] = ros_client

waitLock = ManualResetEventSlim(False) 
ros_client.on_ready(lambda: waitLock.Set()) 

if not waitLock.Wait(TimeSpan.FromSeconds(5)):
    raise Exception('Unable to connect to ROS')

LOGGER.info('ROS connection opened')
# ---------- end ros ----------
connect_2 = PythonScript(ros_client=ros, connect=connect, disconnect=disconnect)  # -> out, ros_client
# ---------- connect_2: Python ----------
import logging
from System import TimeSpan
from System.Threading import ManualResetEventSlim

LOGGER = logging.getLogger('roslibpy')

if connect:
    if not ros_client.is_connected:
        LOGGER.debug('Connecting...')
        waitLock = ManualResetEventSlim(False)
        ros_client.on_ready(lambda: waitLock.Set())
        ros_client.connect()

        if not waitLock.Wait(TimeSpan.FromSeconds(5)):
            raise Exception('Unable to connect to ROS')
        LOGGER.debug('Reconnected')

if disconnect:
    if ros_client.is_connected:
        ros_client.terminate()
        LOGGER.debug('Terminated')
        
       
if (ros_client.is_connected):
    print('connected')
else:
    print('disconnected')
# ---------- end connect_2 ----------
panel_2 = Panel(connect_2.out)

# ----
# Service: REMOVE OBJECTS
list_2 = ValueList({"by keys": 0, "by frame id": 1}, selected="by frame id")
frame_ids = Integer([5, 6])
keys = Integer([0, 1, 2])
filter = StreamFilter(Gate=list_2, Stream0=keys, Stream1=frame_ids)
ros_service_request = PythonScript(ros_client=connect_2.ros_client, assembly=initial_assembly.assembly, keys=filter, key_type=list_2, send=Button())  # -> out, assembly, bang; inputs keys: list of Int32, key_type: Int32, send: Boolean
# ---------- ros_service_request: Python ----------
import logging
import roslibpy
from roslibpy import Topic
from roslibpy import ServiceRequest
from roslibpy import Service
from roslibpy import Message
from scriptcontext import sticky


LOGGER = logging.getLogger('roslibpy') 

def ros_msg_remove_objects(keys):
    ros_msg = {}
    if key_type == 0: #by keys
        frame_ids = []
        for key in keys:
            id = assembly.network.node_attribute(key, 'frame_id')
            print id
            if id:
                frame_ids.append(id)
    else:
        frame_ids = keys
    ros_msg = {'object_ids':frame_ids}
    #print ros_msg
    return ros_msg

if send:
    print("send")
    if ros_client:
            message = ros_msg_remove_objects(keys) 
            #print (message)  
            if len(msg['object_ids']):
                service_name = '/incon/remove_objects'
                service_type = '/incon_msgs/remove_objects'
                service = roslibpy.Service(ros_client, service_name, service_type)
                request = ServiceRequest(message)
                result = service.call(request, timeout=1) #sending of message
                sticky['result_remove_objects'] = result
                if result:
                    success, num_objects_processed = (result['success'], result['num_objects_processed'])                    
                    bang = True if result['success'] == True else False
            
if 'result_remove_objects' in sticky:
    print sticky['result_remove_objects']

msg = ros_msg_remove_objects(keys)
#print len(msg['object_ids'])
print msg
# ---------- end ros_service_request ----------
panel_3 = Panel(ros_service_request.out)

# ----
# Rhino to App:
# Service: ADD INIT OBJECTS
# 3b.
button = Button()
# 3a.
ros_service_request_2 = PythonScript(ros_client=connect_2.ros_client, assembly=initial_assembly.assembly, send=button)  # -> out, assembly, bang; inputs send: Boolean
# ---------- ros_service_request_2: Python ----------
import logging
import roslibpy
from roslibpy import Topic
from roslibpy import ServiceRequest
from roslibpy import Service
from roslibpy import Message
from scriptcontext import sticky


LOGGER = logging.getLogger('roslibpy') 


len_elems = len(list(assembly.elements()))
print len_elems
if "key_threshold" not in sticky:
    sticky["key_threshold"] = len_elems - 1

sticky["key_threshold"] = len_elems - 1
print sticky["key_threshold"]

def ros_msg_add_objects():
    ros_msg = {}
    pose_stamped_array = []
    for key, element in assembly.elements():
            x,y,z,qw,qx,qy,qz = element.get_pose_quaternion()
            pose_stamped_array.append({'header':{'seq': 0, 'stamp':{'secs': 0, 'nsecs': 0}, 'frame_id': "world"},'object_id':{'data': 5}, 'object_type':{'data': "cylinder_for_iaac_workshop.obj"}, 'pose': {'position': {'x': x, 'y': y, 'z': z}, 'orientation': {'x': qx, 'y': qy, 'z': qz, 'w': qw}}})
    ros_msg['objects'] = pose_stamped_array
    return ros_msg


if send:
    print("send")
    if ros_client:
            message = ros_msg_add_objects() #geometry_msgs/PoseStamped[]                
            service_name = '/incon/add_objects'
            service_type = '/incon_msgs/add_objects'
            service = roslibpy.Service(ros_client, service_name, service_type)
            request = ServiceRequest(message)
            print ("service request is sent")
            result = service.call(request, timeout=1) #sending of message
            sticky['result_add_objects'] = result
            
            
            if result:
                # set the frame_id as received from the app
                added_keys, added_ids = (result['added_keys'], result['added_ids'])
                #for key, id in zip(added_keys, added_ids):
                    #assembly.network.node_attribute(key, 'frame_id', id)
                    
                bang = True if result['success'] == True else False
            
if 'result_add_objects' in sticky:
    print sticky['result_add_objects']



"""
for key in sticky['result_add_objects']['added_keys']:
    print assembly.element(key, data=True)
"""

#for key, element, data in assembly.elements(data=True):
    #print data['frame_id']
# ---------- end ros_service_request_2 ----------
panel_4 = Panel(ros_service_request_2.out)

# ----
# TOPIC LISTENER AND PUBLISHER
start_timer = Button()
stop_timer = Button()
bang_2 = Button()
listening_and_publishing = GhPythonScript(bang=bang_2, start_timer=start_timer, stop_timer=stop_timer)  # -> out, added_elem_frame, frame_id, bang_sound
# ---------- listening_and_publishing: Python ----------
from scriptcontext import sticky
from compas_ghpython.utilities import update_component
from compas.geometry import Frame

assembly = sticky['assembly']


guid = str(ghenv.Component.InstanceGuid)
timer_running_key = "timer_running_" + guid
counter_key = "counter_" + guid

if stop_timer or timer_running_key not in sticky:
    sticky[timer_running_key] = False
    sticky[counter_key] = 0

if start_timer:
    sticky[timer_running_key] = True
    sticky[counter_key] = 0
    

if sticky[timer_running_key]:
    update_component(ghenv, 1000)
    
    sticky[counter_key] += 1
    print(sticky[counter_key])

def handle_object_options():
    options = assembly.current_options
    float_array = []
    for option in options:
        float_array += option
    size_array = len(float_array) / 1
    return float_array, len(options), size_array

def receive_message_object_poses(message):
    #sticky['message'] = str(datetime.datetime.now()) + ': ' + str(message)
    print("receiving")
    sticky['incon_msg_obj_pose'] = message


        
if 'publisher_options' in sticky:
    if sticky['publisher_options']:
        
        publisher_options = sticky['publisher_options']
        float_array, float_size, size_array = handle_object_options()
        
        float_array, float_size, size_array = handle_object_options()
        msg = {'layout': {'dim': [{'label': 'x', 'size': int(float_size), 'stride':int(len(float_array)) }, {'label': 'x', 'size': int(size_array), 'stride':int(size_array)}], 'data_offset': 0}, 'data': float_array}
        publisher_message_options = publisher_options.publish(msg)
        print('++ Publishing OBJECT OPTIONS')
        #print(msg)
    else:
        print('NOT publishing OBJECT OPTIONS')
"""
if 'incon_msg_obj_pose' in sticky:   
    if sticky['incon_msg_obj_pose']:
        
        incon_msg_obj_pose = sticky['incon_msg_obj_pose']
        p = incon_msg_obj_pose['pose']
        frame_id = eval(incon_msg_obj_pose['header']['frame_id'])
        added_elem_frame = Frame.from_quaternion([p['orientation']['w'],p['orientation']['x'], p['orientation']['y'], p['orientation']['z']], point = [p['position']['x'], p['position']['y'], p['position']['z']] )
        print('++ Listening to INCON MSG OBJECT POSE')
        
        #print added_elem_frame
        #print frame_id
    else:
        print('NOT listening to INCON MSG OBJECT POSE')
"""

if 'listener_obj_pose' in sticky:
    if sticky['listener_obj_pose']:
    
        listener_obj_pose = sticky['listener_obj_pose']
        listener_obj_pose.subscribe(receive_message_object_poses)
    
        if 'incon_msg_obj_pose' in sticky and sticky['incon_msg_obj_pose']:
            #bang = True 
            
            incon_msg_obj_poses = sticky['incon_msg_obj_pose']
            print("amount of object placed:" + " " + str(len(incon_msg_obj_poses['poses'])))
            if len(incon_msg_obj_poses['poses']):
                last_element = incon_msg_obj_poses['poses'][0]
                p = last_element ['pose']
                frame_id = eval(last_element['header']['frame_id'])
                added_elem_frame = Frame.from_quaternion([p['orientation']['w'],p['orientation']['x'], p['orientation']['y'], p['orientation']['z']], point = [p['position']['x'], p['position']['y'], p['position']['z']] )

                print('++ Listening to INCON MSG OBJECT POSE')
                print('frame_id: ', frame_id)
    
        else:
            bang = False
            print('NOT receiving INCON MSG OBJECT POSE')
    else:
        print('NOT listening to INCON MSG OBJECT POSE')

#bang = True if bang else False
    
print added_elem_frame
# ---------- end listening_and_publishing ----------
panel_5 = Panel(listening_and_publishing.out)

# ----
# 4.
# App to Rhino:
# Topic: OBJECT POSES
subscribe_incon_object_pose = BooleanToggle(True)
subscribe = PythonScript(ros_client=connect_2.ros_client, subscribe_to_topic=subscribe_incon_object_pose)  # -> out; inputs subscribe_to_topic: Boolean
# ---------- subscribe: Python ----------
import time
import logging
import datetime
import Grasshopper
from roslibpy import Topic
from scriptcontext import sticky

LOGGER = logging.getLogger('roslibpy')
key = 'listener_obj_pose'
#print key

if subscribe_to_topic:
    if ros_client and ros_client.is_connected:
        print("subscribed to topic")
        #listener = Topic(ros_client, '/incon/object_pose', 'geometry_msgs/PoseStamped', compression=None, latch=False, throttle_rate=0, queue_size=15, queue_length=3)
        listener = Topic(ros_client, '/incon/object_poses', 'incon_msgs/PoseStampedArray')
        sticky[key] = listener
    else:
        sticky[key] = None
else:
    sticky[key] = None
# ---------- end subscribe ----------
panel_6 = Panel(subscribe)

panel_7 = Panel(listening_and_publishing.added_elem_frame)

# ----
# 5.
# Element Definition
elem_def = GhPythonScript(assembly=ros_service_request_2.assembly)  # -> elem
# ---------- elem_def: Python ----------
import os
import sys
import json
import math

from compas.geometry import Frame, Plane, Rotation, Vector
from compas.geometry import Circle, Cylinder, Translation
from compas.artists import Artist

from robot_see_robot_do.assembly_reciprocal import Element

rf_unit_offset = assembly.globals['rf_unit_offset']
rf_unit_radius = assembly.globals['rf_unit_radius']
radius = assembly.globals['radius']
height = assembly.globals['height']

cross_section_plane = Plane.from_frame(Frame.worldYZ())
cross_section = Circle(cross_section_plane, radius)
elem_geo = Cylinder(cross_section, height)

elem = Element.from_shape(elem_geo, Frame.worldXY())
# ---------- end elem_def ----------

# ----
# 6.
# Rhino to App
# All arrows that need to be visualized are published via a ROS topic OPTIONS
publish_rhino_options = BooleanToggle(True)
publish = PythonScript(ros_client=connect_2.ros_client, publish_topic=publish_rhino_options)  # -> out
# ---------- publish: Python ----------
import logging
from roslibpy import Topic
from roslibpy import ServiceRequest
from roslibpy import Service
from scriptcontext import sticky

LOGGER = logging.getLogger('roslibpy')


#key = 'publisher_%s' % str(ghenv.Component.InstanceGuid)

key = 'publisher_options'
#print key

if publish_topic:
    #print("publish")
    if ros_client and ros_client.is_connected:
        print("published topic")
        publisher = Topic(ros_client, '/incon/arrows_to_draw', 'std_msgs/Float32MultiArray')
        sticky[key] = publisher
    else:
        sticky[key] = None
else:
    sticky[key] = None
# ---------- end publish ----------
panel_8 = Panel(publish)

pt_2 = Point([<point referenced from the Rhino model> x3])

# ----
# sound
button_2 = Button()
sound = GhPythonScript(init=button_2)  # -> out, ps
# ---------- sound: Python ----------
from threading import Thread, Condition
import time

from scriptcontext import sticky as st
import winsound
import os


sounds = {'add_objects': "add.wav", 'remove_objects': "remove.wav", 'receive_objects': "receive.wav", 'accept_new_object': "accept.wav", 'end': "end.wav"}
DATA = st['DATA_PATH']
#path = os.path.join(DATA, soundfile_name)


     

class PlaySound():
    
    def __init__(self, sounds, path):
        self.sounds = sounds
        self.path = path
        self.sound = sounds['add_objects']
        self.log_messages = []
        self.log_messages_length = 10

        self.iterations = 0        
        self.run_thread_flag = True
        self.log("INIT")
        self.reset()
        self.log("RESET")

    def reset(self):
        self.run_thread_flag = True
        self.t = Thread(target = self.run)
        self.t.daemon = True  # OK for main to exit even if instance is still running
        self.t.paused = True  # start out paused
        self.t.state = Condition()
        
    def resume(self):
        with self.t.state:
            self.t.paused = False
            self.t.state.notify()  # unblock self if waiting

    def pause(self):
        with self.t.state:
            self.t.paused = True  # make self block and wait
    
    def start(self):
        self.t.start()
    
    def join(self):
        self.t.join()
    
    def is_paused(self):
        return self.t.paused
    
    def is_alive(self):
        return self.t.is_alive()
    
    def set_sound(self, sound):
        self.sound = self.sounds[sound]
    
    def run(self):
        self.resume() 
        while True:
            with self.t.state:
                if self.t.paused:
                    self.t.state.wait() # block until notified
                
                if self.run_thread_flag == False:
                    break
                
                ok = self.perform_task()
                
            self.iterations += 1
            
            if self.run_thread_flag == False:
                break

    def perform_task(self):
        """ This method has to be overwitten ... """
        
        self.log("TASK START: ---->>>>>")
        
        # do something
        self.log(self.sound)
        path = os.path.join(DATA, self.sound)
        winsound.PlaySound(path, winsound.SND_FILENAME)
        ok = True
        
        if not ok:
            return False
        
        self.log("----<<<<< TASK FINISHED")
        
        self.run_thread_flag = False
        self.log("run_thread_flag to FALSE")
        return True
    
    def log(self, msg):
        self.log_messages.append("SOUND: " + str(msg))
        if len(self.log_messages) > self.log_messages_length:
            self.log_messages = self.log_messages[-self.log_messages_length:] 
    
    def get_log_messages(self):       
        return "\n".join(self.log_messages)
        

ps = PlaySound(sounds, DATA)
# ---------- end sound ----------

button_3 = Button()
arrow_viz = ColourSwatch(SwatchColor=RGBA(235, 75, 165, 169))
pt_3 = Point([Point(-0.3511781962, 0.3142760018, 0), Point(0.2904568947, 0.3172813184, 0)])
num = Number(120)

# ----
# Rhino receive and add
toggle = BooleanToggle(True)
import_object_pose = GhPythonScript(
    assembly=ros_service_request_2.assembly,
    arrow_viz=arrow_viz,
    elem=elem_def,
    add_new_elem=button_3,
    added_elem_frame=listening_and_publishing.added_elem_frame,
    targets=pt_3,
    angle_threshold=num,
    frame_id=listening_and_publishing.frame_id)  # -> out, planes, added_elem_geo, assembly, robot_keys, add_new_elem; inputs targets: list of Point3d
# ---------- import_object_pose: Python ----------
import os
import sys
import Rhino.Geometry as rg
import ast

from scriptcontext import sticky

from compas.geometry import Frame, Plane, Point
from compas.geometry import Vector
from compas.geometry import Transformation, Translation
from compas.geometry import distance_point_point, angle_vectors
from compas_ghpython import draw_frame
from compas.utilities import normalize_values

from compas.artists import Artist

planes = []
all_options = []
min_dist = 0.25
object_poses = []
options = []
#sticky['robot_keys'] = []

def range_filter(options, base_plane):
    ur_range_max = 1.2
    ur_range_min = 0.75
        
    base_point= Point(base_plane.Origin.X, base_plane.Origin.Y, base_plane.Origin.Z)
    filtered_options = []
    for key, elem_origin, option_vector in options:
        v = Vector.from_start_end(elem_origin, base_point)
        dist = v.length
        if ur_range_min <= dist <= ur_range_max:
            filtered_options.append((key, elem_origin, option_vector))
    return filtered_options

def filter_options(all_options, target_points):
    tps = [Point(p.X, p.Y, p.Z) for p in target_points]
    filtered_options = []
    for tp in tps:
        for key, elem_origin, option_vector in all_options:
            v = Vector.from_start_end(elem_origin, tp)
            angle = angle_vectors(option_vector, v, deg=True)
            if angle < angle_threshold:
                filtered_options.append((key, elem_origin, option_vector))
    return filtered_options

#print("len")
#print(list(assembly.network.nodes()))
#print(list(assembly.network.nodes_where({'key':0})))
#print(((assembly.element(0, data=True))))

if 'assembly' not in sticky:
    sticky['assembly'] = assembly

if 'robot_keys' not in sticky:
    sticky['robot_keys'] = []

    
# visualise the geo of newly received pose
if added_elem_frame:
    T = Transformation.from_frame(added_elem_frame)
    print(type(added_elem_frame))
    added_elem = elem.transformed(T)
    added_elem_geo = Artist(added_elem.mesh).draw()
    elem_plane = Artist(added_elem_frame).draw()

"""
added_elem_geo = []
newly_added = list(assembly.elements())[-2:]
for key, element in newly_added:
    added_elem_geo = Artist(added_elem.mesh).draw()
"""


# check if frame_id exists:
key_frame_id = []
if frame_id:
    
    #key_frame_id = list(assembly.network.nodes_where({'frame_id': frame_id})) #[key for key in assembly.network.nodes_where({'frame_id': frame_id})]
    key_frame_id = [key for key in assembly.network.nodes_where({'frame_id': frame_id})]
    
    print "frame_id, key_frame_id: ", frame_id, key_frame_id
    #print assembly.element(key_frame_id[0])
    #print list(assembly.network.nodes())
    #assembly.network.node_attribute(key_frame_id[0], name='frame_est', value=added_elem_frame)
    #print assembly.network.node_attribute(key_frame_id[0], 'frame_est')
   

#if not len(key_frame_id) and frame_id and add_new_elem: # if frame_id does not yet exist in the assembly
if len(key_frame_id)<2 and frame_id and add_new_elem: # if frame_id does not yet exist in the assembly
    print('hello')
    
    frame_id = frame_id
    p = added_elem_frame.point
    
    
    #add a new module based on the tracked element's location
    assembly.p_key = assembly.parent_key(p, min_dist) # compute parent key
    current_key = assembly.p_key
    print('current_key', current_key)
    e = assembly.element(current_key)
    current_type = e._type
    print('type:', current_type)
    #compute direction
    axis_map = {'X': 0, 'Y': 1, 'Z': 2}
    if p[axis_map[current_type]] < e.frame.point[axis_map[current_type]]:
        direction = 0
        connector_frame = e.connector_frame_2
    else:
        direction = 1
        connector_frame = e.connector_frame_1

    a = connector_frame.point[axis_map[current_type]]
    b = p[axis_map[current_type]]

    if current_type == 'Z':
        b -= e._source.xsize/2.
        
    if abs(a) > abs(b): 
        shift_value = abs(a - b)
    else:
        shift_value = -abs(a - b)
        
    #print(shift_value)
    
    if current_type == 'Y':
        c = connector_frame.point.x - added_elem_frame.point.x
        print (c)
        T = Translation(added_elem_frame.xaxis*-c)
        new_elem_x = elem_x.transformed(T)
    else:
        new_elem_x = elem_x
    

    dict_result = assembly.add_element(elem)
    #dict_result = assembly.add_element_(elem, current_key, direction=0, shift_value=0, placed_by='robot', on_ground=False, module_index=0, frame_id=None, frame_est=None)
    print(dict_result)
    sticky['robot_keys'] = dict_result['keys_robot'] #maybe the list length needs to be checked, if objects are colliding and are therefore not placed!

    #assembly.add_module(elem_x, elem_y, elem_z, current_key, direction, shift_value, on_ground = False, added_frame_id=frame_id)
    #robot_keys = [key for key in assembly.network.nodes()][-2:]
    #sticky['robot_keys'] = robot_keys

robot_keys = sticky['robot_keys']
print('robot keys: ', robot_keys)

"""
for key, element in assembly.elements():
    planes.append(Artist(element.frame).draw())
"""

for key, element in assembly.elements():
    connectors = element.connectors()
    for connector in connectors:
        planes.append(Artist(connector).draw())

## Options
## Options visualization settings
#r = arrow_viz[0]
#g = arrow_viz[1]
#b = arrow_viz[2]
#a = arrow_viz[3]
#min = 0
#max = 255
#
#min,r,g,b,a,max = normalize_values([min,r,g,b,a,max], 0.0, 1.0)
##print r,g,b,a 




"""
for key, element in list(assembly.elements())[-12:]:
    for origin, vector in element.options_vectors_(0.3):
        all_options.append((key, origin, vector))

assembly.all_options = all_options

filtered_options = filter_options(all_options, targets)
options_in_range = range_filter(filtered_options, base_plane)

# Assembly options as Float32MultiArray
for key, elem_origin, vector in filtered_options:
    T = Translation(vector)
    position = elem_origin.transformed(T)
    length = vector.length - element._source.xsize
    x_dir = vector
    y_dir = vector.cross(assembly.element(key).frame.zaxis)
    frame = Frame(position, x_dir, y_dir)
    orientation = frame.quaternion
    #[x,y,z,qw,qx,qy,qz,r,g,b,a,length]
    options.append([position[0], position[1], position[2], orientation[0], orientation[1], orientation[2], orientation[3], r, g, b, a, length])
"""

#print(options)
#assembly.current_options = options
assembly.current_options = options#[:5]
# ---------- end import_object_pose ----------
draw = GhPythonScript(assembly=import_object_pose.assembly, show_assembly=toggle, show_options=Toggle(True))  # -> G_assembly, pr, vr, frames_est, tag_text, tag_point
# ---------- draw: Python ----------
import os
import sys
import Rhino.Geometry as rg

from compas.geometry import Frame
from compas.artists import Artist
from compas.geometry import distance_point_point

G_assembly = []

vr = []
pr = []
tag_text = []
tag_point = []

#key_index = assembly.network.key_index()
#keys = [key_index[key] for key in assembly.network.nodes()]
keys = [key for key, element in assembly.elements()]
elements = [assembly.element(key) for key in keys] 


if show_assembly:
    for key, element in assembly.elements():
        mesh = Artist(element.mesh).draw()
        G_assembly.append(mesh)
        tag_text.append(str(key))
        tag_point.append(Artist(element.frame).draw().Origin)

if show_options:
    for o in assembly.current_options:
        option_frame = Frame.from_quaternion([o[3], o[4], o[5], o[6]], point=[o[0], o[1], o[2]])
        l = o[11]
        start = option_frame.point - option_frame.xaxis*l 
        pr.append(rg.Point3d(start.x, start.y, start.z))
        v = option_frame.xaxis*l 
        vr.append(rg.Vector3d(*tuple(v)))


frames_est = []

for key, element in assembly.elements():
    frame_est = assembly.network.node_attribute(key, 'frame_est')
    if frame_est:
        dist = distance_point_point(frame_est.point, element.frame.point)
        #print('key:', key, 'frame_est:', frame_est, 'desired_pos:',element.frame)
        print(key, dist)
# ---------- end draw ----------
vdis = VectorDisplay(Anchor=draw.pr, Vector=draw.vr)
tag = TextTag(Location=draw.tag_point, Text=draw.tag_text, Colour=ColourSwatch(SwatchColor=RGB(255, 0, 0)))
mesh = Mesh(import_object_pose.added_elem_geo)
panel_9 = Panel(import_object_pose.out)

play = GhPythonScript(
    ps=sound.ps,
    sound_add_objects=ros_service_request_2.bang,
    sound_remove=ros_service_request.bang,
    sound_receive=Button(),
    sound_accept_new_object=button_3,
    sound_end=Button(),
    stop=Button())  # -> out
# ---------- play: Python ----------
if sound_add_objects:
    ps.reset()
    ps.set_sound('add_objects')
    ps.run_thread_flag = True
    ps.start()
    
    
if sound_remove:
    ps.reset()
    ps.set_sound('remove_objects')
    ps.run_thread_flag = True
    ps.start()

if sound_receive:
    ps.reset()
    ps.set_sound('receive_objects')
    ps.run_thread_flag = True
    ps.start()

if sound_accept_new_object:
    ps.reset()
    ps.set_sound('accept_new_object')
    ps.run_thread_flag = True
    ps.start()

if sound_end:
    ps.reset()
    ps.set_sound('end')
    ps.run_thread_flag = True
    ps.start()
    
    
if stop:
    ps.run_thread_flag = False
    ps.join()
    
print(ps.get_log_messages())
# ---------- end play ----------

mesh_2 = Mesh(draw.G_assembly)
pln = Plane(draw.frames_est)
pln_2 = Plane(import_object_pose.planes)

# ----
# Export .json
export = Button()
export_2 = Button()
python = GhPythonScript(
    DATA=py.DATA,
    assembly=import_object_pose.assembly,
    export_to_json=export,
    export_for_start=export_2,
    add_new_elem=import_object_pose.add_new_elem,
    QR_code=pt_2)  # -> out; inputs export_to_json: Boolean, QR_code: list of Point3d
# ---------- python: Python ----------
import os
import compas

from datetime import datetime
now = datetime.now() # current date and time

date_time = now.strftime("%Y_%m_%d_%H_%M_%S")
filename = "rsrd/rsrd_current_assembly_{}.json".format(date_time)

QRcodes= []
for p in QR_code:
    QRcodes.append(compas.geometry.Frame(p, (1, 0, 0),(0, 1, 0)))


if export_for_start:
    filename = "rsrd/rsrd_start_assembly_{}.json".format(date_time)
    print (filename)
    PATH = os.path.join(DATA, filename)
    assembly.export_to_json_incon(PATH, QRcodes, True)

if export_to_json or add_new_elem:
    filename = "rsrd/rsrd_current_assembly_{}.json".format(date_time)
    print (filename)
    PATH = os.path.join(DATA, filename)
    assembly.to_json(PATH, True)
# ---------- end python ----------
filename = Panel(python)
